# Grasshopper definition Chovghi - Deformation.gh (Grasshopper 1.0.7)
# Copyright: Felswind
# plug-ins: Karamba3D

pline_rods = Curve([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])
support_point = Point(Point(0, 0, 0))
pline_nodes = Curve([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])
colour_swatch = ColourSwatch(SwatchColor=RGB(184, 144, 88))
material_selection_karamba3d = MaterialSelectionKaramba3D(Color=colour_swatch, menu=[dropdown(2), dropdown(3)])
cross_section_karamba3d = CrossSectionKaramba3D(
    FamilyNameOfCrossSection="DefaultCroSec",
    Color=colour_swatch,
    Material=material_selection_karamba3d,
    Diameter_cm=2.5,
    WallThickness_cm=1.25,
    mode="Circular Hollow")
line_to_beam_karamba3d = LineToBeamKaramba3D(
    Line=pline_rods,
    Color=colour_swatch,
    CrossSection=cross_section_karamba3d,
    New=True,
    Remove=True,
    LimitDistance_m=0.005,
    Bending=True,
    SetBucklingLength=True,
    ToPolylineMaxAngle=0.03,
    ToPolylineTolerance=0.01,
    ToPolylineMaxEdgeLength=0.25)  # -> Element, Points, Info
line_to_beam_karamba3d_2 = LineToBeamKaramba3D(
    Line=pline_nodes,
    Color=colour_swatch,
    CrossSection=cross_section_karamba3d,
    New=True,
    Remove=True,
    LimitDistance_m=0.005,
    Bending=True,
    SetBucklingLength=True,
    ToPolylineMaxAngle=0.03,
    ToPolylineTolerance=0.01,
    ToPolylineMaxEdgeLength=0.25)  # -> Element, Points, Info
support_karamba3d = SupportKaramba3D(PosInd=support_point, menu=[buttons(on, on, on, on, on, on)])
loads_karamba3d = LoadsKaramba3D(Vector=Vector(0, 0, -1), LCase="0", mode="Gravity")
assemble_model_karamba3d = AssembleModelKaramba3D(
    Elem=flatten([line_to_beam_karamba3d.Element, line_to_beam_karamba3d_2.Element]),
    Support=support_karamba3d,
    Load=loads_karamba3d,
    LimitDistance_m=0.005)  # -> Model, Info, Mass_kg, CenterOfGravity, LoadCaseNames
analyze_karamba3d = AnalyzeKaramba3D(Model=assemble_model_karamba3d.Model)  # -> CalculatedModel, MaximumDisplacement_cm, ResultingForceOfGravity_kN, ElasticEnergyChange_kNm
model_view_karamba3d = ModelViewKaramba3D(Model=analyze_karamba3d.CalculatedModel, ResultFactors=1, ResultCase=-1)  # -> Model, DeformedMesh, DeformedAxes, DeformedModel
beam_view_karamba3d = BeamViewKaramba3D(Model=model_view_karamba3d.Model)  # -> Model, MeshesOfRenderedBeams, DeformedBeamAxes, LegendColors, LegendTags
