# Grasshopper definition Chovghi - Equilibrium local.ghx (Grasshopper 1.0.7)
# Copyright: Felswind

point = Point([<point referenced from the Rhino model> x3])
point_2 = Point(<point referenced from the Rhino model>)
local_eq = LocalEquilibrium(cp=point, sp=point_2)  # -> la, rp; inputs cp: list of Point3d, sp: list of Point3d
# ---------- local_eq: Python ----------
"""Calculates the local static Equilibrium condition.
    Inputs:
        cp: Mid Points of the elements
    Output:
        la: lever arm [m]
        rp: Position of the Resultant Z-Vector [Point]"""

__author__ = "Frederic Chovghi"

ghenv.Component.Name = "Local Equilibrium"
ghenv.Component.NickName = "Local Eq."

import rhinoscriptsyntax as rs
import math



##########################################################################################
## Main Inputs
##########################################################################################

l = 0.5 #Length of the Rods [m]
r = 0.025 #Radius of the Pipe Elements



##########################################################################################
## Function
##########################################################################################

#Step 1: Calculate single Resultants
vol = l * math.pi * r**2 #Volume Vector for Rods; Material weight is considered as constant
cp0 = [(p[0], p[1], 0) for p in cp] #Planar Center Points of the Resultant

#Step 2: Calculate the Resultant for each branch
res_pos_loc = []
res_pos_x = 0
res_pos_y = 0

for i, cp0l in enumerate(cp0):
    m_x = cp0l[0] * vol
    m_y = cp0l[1] * vol
    
    res_pos_x += m_x #Local Moment in x-dir
    res_pos_y += m_y #Local Moment in y-dir
    
    res_pos_x_loc = res_pos_x / (vol*(i+1)) #Position of Resultant in x-dir
    res_pos_y_loc = res_pos_y / (vol*(i+1)) #Position of Resultant in y-dir
    
    rp = rs.AddPoint(res_pos_x_loc, res_pos_y_loc, 0)
    
    #Lever Arm for a single Branch
    if len(sp) == 1:
        la = rs.Distance(rp, sp)
    
    #Lever Arm for two Branches
    if len(sp) == 2:
        l = rs.AddLine(sp[0], sp[1])
        la = rs.Distance(rs.EvaluateCurve(l, rs.CurveClosestPoint(l, rp)), rp)
    
    #Lever Arm for multiple Branches
# ---------- end local_eq ----------
panel = Panel(local_eq.la)
point_3 = Point(local_eq.rp)
