# Grasshopper definition Chovghi - Equilibrium.gh (Grasshopper 1.0.7)
# Copyright: Felswind

supports = Brep([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])

elements = Brep([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])
hold = BooleanToggle(True)
step = Button()
reset = Button()
stat_eq = StaticEquilibrium(e=elements, sp=supports, s=hold, st=step, res=reset)  # -> e, se, col, res; inputs e: list, sp: list
# ---------- stat_eq: Python ----------
"""Calculates the static Equilibrium condition.
    Inputs:
        e: Single Elements as BREPs; First Element is the support Element
        sp: Support Elements
        s: Allows temporary support by a second robot
        
        st: Iteration Step
        rs: Reset Iteration
        
    Output:
        e: Single Elements as BREPs
        se: Static Equilibrium consition
        col: Display colour
        res: Resultant Force"""

__author__ = "Frederic Chovghi"

ghenv.Component.Name = "Static Equilibrium"
ghenv.Component.NickName = "Stat. Eq."


#############################################################################
## Import and Eport
#############################################################################

import rhinoscriptsyntax as rs
import scriptcontext as sc

se = []
col = []
if s == True: s_glob = True

## global value
if 'step' not in sc.sticky:sc.sticky['step'] = int(len(sp)-1)
if st == True: sc.sticky['step']+=1
if res == True: sc.sticky['step'] = int(len(sp)-1)
if sc.sticky['step'] > len(e)+len(sp)-1: sc.sticky['step'] = int(len(sp)-1)


#############################################################################
## Main
#############################################################################

sa = rs.BoundingBox(sp) #support area in which the resultant shall lie on
sa = rs.AddSrfPt(sa[:4])
sa = rs.ExtrudeSurface(rs.MoveObject(sa, (0,0,-0.1)), rs.AddLine((0,0,-0.1), (0,0,0.1)))

sp.extend(e)
e = sp

e = e[:int(sc.sticky['step'])+1]
vol = [rs.SurfaceVolume(e[x])[0] for x in range(len(e))] #volume Vectors; Material weight is considered as constant
cen = [rs.SurfaceVolumeCentroid(e[x])[0] for x in range(len(e))]
cen = [(cen[x][0], cen[x][1], 0) for x in range(len(cen))] #planar Center-nodes



#############################################################################
## Global Equlibrium
#############################################################################

res_pos_loc = []
res_pos_x = 0
res_pos_y = 0

for i in range(len(e)):
    m_x = cen[i][0] * vol [i]
    m_y = cen[i][1] * vol [i]
    
    res_pos_x += m_x
    res_pos_y += m_y
    
    res_pos_x_loc = res_pos_x / sum(vol[:(i+1)]) #moment in x-dir
    res_pos_y_loc = res_pos_y / sum(vol[:(i+1)]) #moment in y-dir
    
    res_loc = rs.AddLine((res_pos_x_loc, res_pos_y_loc, 0), (res_pos_x_loc, res_pos_y_loc, sum(vol[:(i+1)]))) #Resultant
    se_loc = rs.IsPointInSurface(sa, (res_pos_x_loc, res_pos_y_loc, 0))
    
    if s_glob == True and s == False:
        if i > s_int+1: s = True
    
    if se_loc != True:
        if str(type(se)) == "<type 'list'>": se.append('It.: "'+ str(i) + '" :Structure is in Equilibrium')
        if str(type(col)) == "<type 'list'>": col.append('100, 200, 100, 255')
    
    if se_loc != False and s == False:
        se = ('Structure is NOT in Equilibrium')
        col = ('200, 0, 0, 255')
    
    if se_loc != False and s == True:
        if str(type(se)) == "<type 'list'>": se.append('It.: "'+ str(i) + '" Structure is only in Equilibrium if Robot holds the last Element')
        if str(type(col)) == "<type 'list'>": col.append('125, 125, 200, 255')
        s = False
        s_int = i
    
    res = res_loc
# ---------- end stat_eq ----------
panel = Panel(stat_eq.se)
custom_preview = CustomPreview(Geometry=stat_eq.e, Material=stat_eq.col)
resultant = Geometry(stat_eq.res)
