# Grasshopper definition ex2_firebase.ghx (Grasshopper 1.0.7)

panel = Panel("Unload libraries")
bang = Button()
unload = PythonScript(bang=bang)
# ---------- unload: Python ----------
from compas_rhino.utilities.misc import get_tolerance
from compas_rhino.utilities.misc import unload_modules

unload_modules("cdf_2023")
# ---------- end unload ----------

py = PythonScript()  # -> ENVIRONMENT_NAME, HERE, DATA
# ---------- py: Python ----------
import os
import compas_bootstrapper

HERE = os.path.dirname(ghdoc.Path)
DATA = os.path.abspath(os.path.join(HERE, "..", "data"))
ENVIRONMENT_NAME = compas_bootstrapper.ENVIRONMENT_NAME
print(HERE)
print(DATA)
print(ENVIRONMENT_NAME)
# ---------- end py ----------

# ----
# Load Assembly
# Import assembly from .json.
import = Button(ExpressionNormal="True", ExpressionPressed="False")
initial_assembly = GhPythonScript(DATA=py.DATA, import_from_json=import)  # -> out, assembly; inputs import_from_json: Boolean
# ---------- initial_assembly: Python ----------
import os
import json
from scriptcontext import sticky

from cdf_2023.assembly import Assembly

if import_from_json:
    filename = "assembly_test.json"
    PATH = os.path.join(DATA, "assembly", filename)
    assembly = Assembly.from_json(PATH)
# ---------- end initial_assembly ----------

# ----
# Firebase
upload = Button()
update = Button()
start = BooleanToggle(False)
firebase = GhPythonScript(
    assembly=initial_assembly.assembly,
    DATA=py.DATA,
    start_proxy_server=start,
    upload_assembly=upload,
    update_assembly=update)  # -> out
# ---------- firebase: Python ----------
from compas.rpc import Proxy

dict = {'alanisawesome': {'date_of_birth': 'June 23, 1912', 'full_name': 'Alan Turing'}}

if start_proxy_server:
    firebase = Proxy('cdf_2023.firebase', python='C://Users//lidet//anaconda3//envs//urfab//python.exe', url='http://127.0.0.1')
    if upload_assembly:
        firebase.upload_from_file("C:/Users/lidet/workspace/projects/cdf_2023/data/assembly/assembly_test.json")
    if update_assembly:
        firebase.upload_dict(dict)
# ---------- end firebase ----------
panel_2 = Panel(firebase)

panel_3 = Panel(py.ENVIRONMENT_NAME)

# ----
# Network Vizualization
number_slider = Slider(27, range=0..47)
show = BooleanToggle(False)
network_viz = GhPythonScript(assembly=initial_assembly.assembly, show_network=show, key=number_slider)  # -> out, nodes, edges, current_node, current_node_neighbors; inputs key: Int32
# ---------- network_viz: Python ----------
import sys, os
import ghpythonlib.components as ghcomp
from compas.datastructures import Network
from compas_ghpython.artists import NetworkArtist
from compas_rhino.geometry import RhinoLine

import compas_ghpython
import Rhino.Geometry as rg


data = assembly.network.to_data()
network = Network.from_data(data)

print assembly.network.number_of_nodes()

def draw_network(network):
    """Draw a network in Grasshopper.
    """
    points = []
    for key, attr in network.nodes(True):
        points.append({
            'pos': network.node_coordinates(key),
        })

    lines = []
    for (u, v), attr in network.edges(True):
        lines.append({
            'start': network.node_coordinates(u),
            'end': network.node_coordinates(v),
        })

    points_rg = compas_ghpython.draw_points(points)
    lines_rg = compas_ghpython.draw_lines(lines)

    return points_rg, lines_rg

if show_network:
    nodes, edges = draw_network(network)
    
    current_node = {'pos': network.node_coordinates(key), 'radius': 0.03}
    current_node = compas_ghpython.draw_spheres([current_node])
    
    current_node_neighbors_keys = network.neighbors(key)
    current_node_neighbors = [{'pos': network.node_coordinates(key), 'radius': 0.02} for key in current_node_neighbors_keys]
    current_node_neighbors = compas_ghpython.draw_spheres(current_node_neighbors)
# ---------- end network_viz ----------
pt = Point(network_viz.nodes)
line = Line(network_viz.edges)
brep = Brep(network_viz.current_node)
brep_2 = Brep(network_viz.current_node_neighbors)
preview = CustomPreview(Geometry=[brep, line], Material=ColourSwatch(SwatchColor=RGB(0, 0, 0)))
preview_2 = CustomPreview(Geometry=brep_2, Material=ColourSwatch(SwatchColor=RGB(255, 207, 207)))

# ----
# Assembly Vizualization
# 1. Visualize assembly.
# 2. Visualize selected option.
# 3. Visuilize current options (all/filtered).
show_2 = BooleanToggle(False)
show_3 = BooleanToggle(True)
draw = PythonScript(assembly=initial_assembly.assembly, show_assembly=show_3, show_keys=show_2)  # -> out, G_initial, G_built_by_human, G_built_by_robot, connector_planes, tag_point, tag_text
# ---------- draw: Python ----------
import os
import sys
from scriptcontext import sticky as st
import Rhino.Geometry as rg

import math
from math import pi

from compas.artists import Artist

connector_planes = []
G_initial = []
G_built_by_human = []
G_built_by_robot = []
flip = 'AA'

tag_text = []
tag_point = []

radius = 0.01

def show(element, output_geo, color):
    mesh = Artist(element.mesh).draw(color)
    output_geo.append(mesh)

def show_multiple(elements, output_geo, color):
    for element in elements:
        mesh = Artist(element.mesh).draw(color)
        output_geo.append(mesh)
        


robot_keys = list(assembly.network.nodes_where({'placed_by':'robot'}))
human_keys = list(assembly.network.nodes_where({'placed_by':'human'}))
initial_keys = list(assembly.network.nodes_where({'placed_by':'initial'}))

robot_elements = [assembly.element(key) for key in robot_keys] 
human_elements = [assembly.element(key) for key in human_keys] 
initial_elements = [assembly.element(key) for key in initial_keys] 

# Visualize all open connector frames
connector_planes = [Artist(frame).draw() for elem_connectors in assembly.connectors(state='open') for frame in elem_connectors]

# Visualize assembly
if show_assembly:
    for element in robot_elements:
        mesh = Artist(element.mesh).draw([0.7,0.7,0.75,0.1])
        G_built_by_robot.append(mesh)
    for element in human_elements:
        mesh = Artist(element.mesh).draw([1.,0.7,0.65,0.1])
        G_built_by_human.append(mesh)
    for element in initial_elements:
        mesh = Artist(element.mesh).draw([0.8,0.8,0.8,0.1])
        G_initial.append(mesh)


if show_keys:
    for key, element in assembly.elements():
        tag_text.append(str(key))
        tag_point.append(Artist(element.frame).draw().Origin)
# ---------- end draw ----------
tag = TextTag(Location=draw.tag_point, Text=draw.tag_text)
mesh = Mesh(draw.G_built_by_robot)
pln = Plane(draw.connector_planes)
mesh_2 = Mesh(draw.G_initial)
mesh_3 = Mesh(draw.G_built_by_human)
custom_preview = CustomPreview(Geometry=mesh_2, Material=ColourSwatch(SwatchColor=RGBA(189, 189, 189, 197)))
custom_preview_2 = CustomPreview(Geometry=mesh_3, Material=ColourSwatch(SwatchColor=RGB(255, 196, 196)))
custom_preview_3 = CustomPreview(Geometry=mesh, Material=ColourSwatch(SwatchColor=RGBA(154, 196, 212, 164)))
