# Grasshopper definition ex3_assembly_target_geometry_growth.ghx (Grasshopper 1.0.7)
# plug-ins: CEM_Build_Topology, CEM_Deviation, CEM_Extract_Topology, CEM_Support, CEM_Trail, CEM_Calculate_Structure, CEM_Extract_Structure, CEM_Origin_Node, CEM_Load

r_m = Slider(3.2, range=0.1..100)
l_int = Slider(9, range=2..100)
res_int = Slider(10, range=4..100)

# ----
# 00 - Input
tp = GhPythonScript(r=r_m, l=l_int, res=res_int)  # -> T, N, Dt, D, S; inputs r: Int32, l: Int32, res: Int32
# ---------- tp: Python ----------
"""Creates a CEM Topology.
    Inputs:
        r: Base radius [m]
        l: Number of layer [int]
        res: Resolution [int]
    Output:
        T: Trail elements
        N: Nodes of the strucutre
        Dt: First Ring of Deviation Elements
        D: Deviation Elements
        S: Support Nodes"""

__author__ = "Frederic Chovghi"

import ghpythonlib.components as gh



###########################################################
## Create CEM Topology
###########################################################

T = []
N = []
Dt = []
D = []
S = []

bp = gh.XYPlane(gh.ConstructPoint(0,0,0)) #Base  plane

for i in range(l):
    
    circle = gh.Circle(bp, r+(i*0.5))
    cp = gh.DivideCurve(circle, res, False)[0]
    N.extend(cp)
    
    pl = gh.PolyLine(cp, True)
    pl = gh.Explode(pl, True)[0]
    
    if i != 0:
        tl = [gh.Line(cp[x], cpp[x]) for x in range(len(cp))]
        T.extend(tl)
    
    cpp = cp[:]
    
    #Export Elements
    if i == 0: Dt.extend(pl)
    if i != 0: D.extend(pl)
    
    if i ==l-1: S.extend(cp)
# ---------- end tp ----------

number_slider = Slider(2, range=-100..100)

# ----
# Color Coding
colour_swatch = ColourSwatch(SwatchColor=RGB(255, 192, 0))
color_coding = GhPythonScript(
    is_planned=colour_swatch,
    is_built=ColourSwatch(SwatchColor=RGB(207, 255, 181)),
    is_support=ColourSwatch(SwatchColor=RGB(0, 0, 255)),
    has_open_connector=ColourSwatch(SwatchColor=RGB(126, 255, 61)),
    has_no_open_connectors=ColourSwatch(SwatchColor=RGB(200, 200, 200)),
    is_built_by_robot=ColourSwatch(SwatchColor=RGB(175, 224, 220)),
    is_built_by_human=ColourSwatch(SwatchColor=RGB(242, 229, 0)))  # -> out, color_coding
# ---------- color_coding: Python ----------
import rhinoscriptsyntax as rs
from compas.colors import Color


color_is_planned = Color(is_planned.R/255 , is_planned.G/255, is_planned.B/255)
color_is_built = Color(is_built.R/255 , is_built.G/255, is_built.B/255)
color_is_support = Color(is_support.R/255 , is_support.G/255, is_support.B/255)
color_has_open_connector = Color(has_open_connector.R/255 , has_open_connector.G/255,has_open_connector.B/255)
color_has_no_open_connectors = Color(has_no_open_connectors.R/255 , has_no_open_connectors.G/255, has_no_open_connectors.B/255)
color_is_built_by_robot = Color(is_built_by_robot.R/255 , is_built_by_robot.G/255, is_built_by_robot.B/255)
color_is_built_by_human = Color(is_built_by_human.R/255 , is_built_by_human.G/255, is_built_by_human.B/255)

color_coding = {'color_is_planned':color_is_planned, 'color_is_built':color_is_built, 'color_is_support':color_is_support, 'color_has_open_connector':color_has_open_connector, 'color_has_no_open_connectors':color_has_no_open_connectors, 'color_is_built_by_robot':color_is_built_by_robot, 'color_is_built_by_human':color_is_built_by_human}

print color_coding
# ---------- end color_coding ----------
panel = Panel(color_coding.out)

panel_2 = Panel("Unload libraries")
bang = Button()
unload = PythonScript(bang=bang)
# ---------- unload: Python ----------
from compas_rhino.utilities.misc import get_tolerance
from compas_rhino.utilities.misc import unload_modules

unload_modules("cdf_2023")
# ---------- end unload ----------

# ----
# New assembly & element definition
# Create an element object.
reset_assembly = Button()
globals = GhPythonScript(reset=reset_assembly)  # -> out, assembly
# ---------- globals: Python ----------
from cdf_2023.assembly import Assembly

# create assembly
assembly = Assembly()

# create a dictionary to store global value in 
assembly.globals = {}

# define global values
assembly.globals['rod_radius'] = 0.011
assembly.globals['rod_length'] = 0.8
assembly.globals['rf_unit_offset'] = 0.22
assembly.globals['rf_unit_radius'] = 0.12


print assembly.globals
# ---------- end globals ----------
assembly_globals = Panel(globals.out)
show = BooleanToggle(False)
brep = Brep(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)
brep_2 = Brep(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)
show_2 = BooleanToggle(False)
elem_def = GhPythonScript(assembly=globals.assembly, show_connectors=show_2, angle=Slider(6, range=4..12), cr1=brep, cr2=brep_2)  # -> assembly, elem; inputs cr1: Surface, cr2: Surface
# ---------- elem_def: Python ----------
import os
import sys
import json
import math

from compas.geometry import Frame, Plane, Rotation, Vector, Point
from compas.geometry import Circle, Cylinder, Translation, Line, Cone
from compas.artists import Artist
from compas_rhino.conversions import RhinoSurface
from cdf_2023.assembly import Element

rf_unit_offset = assembly.globals['rf_unit_offset']
rf_unit_radius = assembly.globals['rf_unit_radius']
radius = assembly.globals['rod_radius']
length = assembly.globals['rod_length']

cross_section_plane = Plane.from_frame(Frame.worldYZ())
cross_section = Circle(cross_section_plane, radius)
elem_geo = Cylinder(cross_section, length)
#elem_geo = Line([-length/2.,0,0],[length/2.,0,0])

elem = Element.from_shape(elem_geo, Frame.worldXY())

connector_frame_1 = Frame([rf_unit_offset,-rf_unit_radius/2,0], [1,0,0], [0,1,0])
connector_frame_2 = Frame([-rf_unit_offset,rf_unit_radius/2,0], [-1,0,0], [0,-1,0])

R1 = Rotation.from_axis_and_angle(connector_frame_1.yaxis, math.radians(angle), connector_frame_1.point)
R2 = Rotation.from_axis_and_angle(connector_frame_2.yaxis, math.radians(angle), connector_frame_2.point)

connector_frame_1.transform(R1)
connector_frame_2.transform(R2)

elem.connector_frame_1 = connector_frame_1
elem.connector_frame_2 = connector_frame_2

elem.line = Line([-length/2.,0,0],[length/2.,0,0])


#circle_frame_1 = Frame([-0.34,0,0],[0,0,-1],[0,1,0])
#circle_frame_2 = Frame([0.34,0,0],[0,0,1],[0,1,0])
#circle_1 = Circle(Plane.from_frame(circle_frame_1), 0.5)
#circle_2 = Circle(Plane.from_frame(circle_frame_2), 0.5)
#cone_2 = Cone(circle_1, 0.32)
#cone_1 = Cone(circle_2, 0.32)
#
#elem.connector_range_1 = cone_1
#elem.connector_range_2 = cone_2

#print elem.connector_range_1

source1 = RhinoSurface.from_geometry(cr1)
source2 = RhinoSurface.from_geometry(cr2)


elem.connector_range_1 = source1.to_compas()
elem.connector_range_2 = source2.to_compas()
# ---------- end elem_def ----------
draw = PythonScript(elements=elem_def.elem, show=show)  # -> M, F, C; inputs elements: list
# ---------- draw: Python ----------
from compas.artists import Artist

M = []
C = []
F = []
T = []

if show:
    for elem in elements:
        C.append(Artist(elem.connector_frame_1).draw())
        C.append(Artist(elem.connector_frame_2).draw())
        M += [Artist(elem._mesh).draw([0,0,1,1])]
        F += [Artist(elem.frame).draw()]
        T += [Artist(elem.tool_frame).draw()]
# ---------- end draw ----------
pln = Plane(draw.F)
mesh = Mesh(draw.M)
pln_2 = Plane(draw.C)
custom_preview = CustomPreview(Geometry=mesh, Material=ColourSwatch(SwatchColor=RGB(221, 0, 0)))

py = PythonScript()  # -> ENVIRONMENT_NAME, HERE, DATA
# ---------- py: Python ----------
import os
import compas_bootstrapper

HERE = os.path.dirname(ghdoc.Path)
DATA = os.path.abspath(os.path.join(HERE, "..", "data"))
ENVIRONMENT_NAME = compas_bootstrapper.ENVIRONMENT_NAME
print(HERE)
print(DATA)
print(ENVIRONMENT_NAME)
# ---------- end py ----------

# ----
# Load assembly
# Import assembly from .json.
list = ValueList({"1. Assembly model": 0, "2. Assembly model": 1, "3. Assembly model": 2}, selected="1. Assembly model")
import = Button(ExpressionNormal="True", ExpressionPressed="False")
initial_assembly = GhPythonScript(DATA=py.DATA, assembly_preset=list, import_from_json=import)  # -> out, assembly; inputs import_from_json: Boolean
# ---------- initial_assembly: Python ----------
import os
import json
from scriptcontext import sticky

from cdf_2023.assembly import Assembly

if import_from_json:
    if assembly_preset == 0:
        filename = "2023_06_29_17_41_my_design.json"
    elif assembly_preset == 1:
        filename = "230622_design_6.json"
    else:
        filename = "study_1e.json"
    PATH = os.path.join(DATA, "assembly", filename)
    assembly = Assembly.from_json(PATH)
    assembly.support_keys = []

# create a dictionary to store global value in 
assembly.globals = {}

# define global values
assembly.globals['rod_radius'] = 0.01
assembly.globals['rod_length'] = 0.8
assembly.globals['rf_unit_offset'] = 0.2
assembly.globals['rf_unit_radius'] = 0.15
# ---------- end initial_assembly ----------

# ----
# Choose assembly
list_2 = ValueList({"New assembly": 1, "From json": 2}, selected="New assembly")
python = GhPythonScript(selection=list_2, new_assembly=elem_def.assembly, imported_assembly=initial_assembly.assembly)  # -> out, assembly
# ---------- python: Python ----------
import rhinoscriptsyntax as rs

if selection == 1:
    assembly = new_assembly
else:
    assembly = imported_assembly
# ---------- end python ----------

panel_3 = Panel(py.ENVIRONMENT_NAME)

list_3 = ValueList({"1. Add a SINGLE options-pair": 0, "2. Add TWO options-pairs": 1}, selected="1. Add a SINGLE options-pair")
get_joining_options = BooleanToggle(False)
show_new_element = BooleanToggle(True)
join_branches = Button()

# ----
# Compute!
random_key = BooleanToggle(False)
compute = Button()

# ----
# Reset key!
reset_key = Button()

_4_planes = Plane([Plane(origin=(-0.002611679333, -0.7707588361, 0.4118038534), x=(0.00338212045, -0.1931022184, 0.9811728158), y=(-0.9998466536, -0.01751197807, 0)), Plane(origin=(-0.7707588361, 0.002611679333, 0.4118038534), x=(-0.1931022184, -0.00338212045, 0.9811728158), y=(-0.01751197807, 0.9998466536, 0)), Plane(origin=(0.002611679333, 0.7707588361, 0.4118038534), x=(-0.00338212045, 0.1931022184, 0.9811728158), y=(0.9998466536, 0.01751197807, 0)), Plane(origin=(0.7707588361, -0.002611679333, 0.4118038534), x=(0.1931022184, 0.00338212045, 0.9811728158), y=(0.01751197807, -0.9998466536, 0))])

# ----
# Initial Assembly
pt = Point(Point(-0.002611679333, -0.4167082675, 0.4218038534))
y = Curve(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)
x = Curve(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)
worldxy = Plane(PlaneXY(0, 0, 0))
pl = ConstructPlane(Origin=pt, XAxis=x, YAxis=y)
initial_configuration = GhPythonScript(assembly=python.assembly, selection=list_2, planes=_4_planes, elem=elem_def.elem)  # -> out, assembly, connector_planes; inputs planes: list of Plane
# ---------- initial_configuration: Python ----------
import Rhino.Geometry as rg
import math
from scriptcontext import sticky as st

from compas.geometry import Frame, Vector
from compas.geometry import Rotation, Transformation
from compas.artists import Artist


connector_planes = []
support_keys = []


if selection == 1:
    
    radius = assembly.globals['rod_radius']
    length = assembly.globals['rod_length']
    rf_unit_offset = assembly.globals['rf_unit_offset']
    rf_unit_radius = assembly.globals['rf_unit_radius']

    for plane in planes:
        T1 = Transformation.from_frame_to_frame(Frame.worldXY(), Frame(plane.Origin, plane.XAxis, plane.YAxis))
        elem_1 = elem.transformed(T1)
        
        R1 = Rotation.from_axis_and_angle(elem_1.frame.zaxis, math.radians(120), [0,0,0])
        R2 = Rotation.from_axis_and_angle(elem_1.frame.zaxis, math.radians(240), [0,0,0])
        
        # set connector state
        elem_1.connector_1_state = True
        elem_1.connector_2_state = False
    
        # add element to assembly
        assembly.add_element(elem_1, placed_by='human', is_support=True, is_built=True,frame_id=None)
    
    # show open connectors
#    if show_open_connectors:
#        for key, connectors in assembly.connectors(state='open'):
#            for connector in connectors:
#                connector_planes.append(Artist(connector).draw())
    
#    for key, element in assembly.elements():
#        assembly.network.node_attribute(key, 'is_support', True)
        
    #assembly.support_keys = support_keys
# ---------- end initial_configuration ----------
pln_3 = Plane(initial_configuration.connector_planes)

# ----
# 4. Settings
distance_weight = Slider(0, range=0..1)
angle_weight = Slider(1, range=0.1..1.1)
list_4 = ValueList({"1. GLOBAL stability": 0, "2. LOCAL stability": 1, "3. NO stability criteria": 2}, selected="2. LOCAL stability")
show_resultant = BooleanToggle(True)
brep_3 = Brep(<brep referenced from the Rhino model>)
collision = BooleanToggle(True)
support_geo = Brep(<brep referenced from the Rhino model>)
guiding_geo = Mesh(brep_3)

# ----
# 2. Set parameters
key_at_index = Slider(27, range=0..500)
shift_value = Slider(-0.05, range=-0.1..0.05)
angle = Slider(144.28, range=0..360)
get_key_by_index = BooleanToggle(False)
flip_human_robot = BooleanToggle(True)
close_connector = Button()
filter_keys = BooleanToggle(True)
previous = Button()
next = Button()

# ----
# 3. Compute parameters
options_num = Slider(100, range=1..300)

# ----
# 1. Select mode
list_5 = ValueList({"1. 'Manual mode'": 0, "2. 'Automatic mode'": 1, "3. Join branches'": 2}, selected="1. 'Manual mode'")

# ----
# 5. Move robots origins
mobile_robot_2_base_plane = Plane(Plane(origin=(1.023104837, -0.1456146025, 0), x=(-0.1017420154, 0.9948108173, 0), y=(-0.9948108173, -0.1017420154, 0)))
mobile_robot_1_base_plane = Plane(Plane(origin=(-1.910781252, 0.1750038594, 0), x=(0.05329059407, -0.9985790467, 0), y=(0.9985790467, 0.05329059407, 0)))

# ----
# 6. Settings
number_slider_2 = Slider(0.2, range=0..1)
shift_value_2 = Slider(0.3, range=-1..1)
pair_index = Slider(0, range=0..10)
point1 = Slider(0.72, range=0..1)
point2 = Slider(0.7, range=0..1)

show_3 = BooleanToggle(True)

# ----
# Transform Assembly
toggle = BooleanToggle(False)
pt_2 = Point(Point(-0.02953462923, 0.4150182858, 0.4218038534))
x_2 = Curve(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)
y_2 = Curve(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)
pl_2 = ConstructPlane(Origin=pt_2, XAxis=x_2, YAxis=y_2)
transform = GhPythonScript(assembly=initial_configuration.assembly, transform=toggle, trnsf_plane=pl_2)  # -> out, assembly
# ---------- transform: Python ----------
from compas.geometry import Frame
from compas.geometry import Transformation
import Rhino.Geometry as rg
from compas.artists import Artist


if transform:
    T = Transformation.from_frame_to_frame(assembly.element(0).frame, Frame(trnsf_plane.Origin, trnsf_plane.XAxis, trnsf_plane.YAxis))
    assembly.transform(T)
    assembly.network.transform(T)
# ---------- end transform ----------

# ---- group: capture
# Capture to bitmap
number_slider_3 = Slider(2, range=0..10)
viewport_name = Text("workflow_2")
capture_to_bitmap = PythonScript(DATA=py.DATA, capture=Button(), viewport_name=viewport_name, idx=number_slider_3)  # -> out, a; inputs capture: Boolean, idx: Int32
# ---------- capture_to_bitmap: Python ----------
import Rhino
import System.Drawing
from scriptcontext import sticky as st

import sys, os
import ghpythonlib.components as ghcomp
import Grasshopper as gh
import datetime


ghComp = ghenv.Component
ghDoc = ghComp.OnPingDocument()

def rCommonCap(filePath, viewportName,scaleFactor):
    RhinoDocument = Rhino.RhinoDoc.ActiveDoc
    view = RhinoDocument.Views.Find(viewportName, False)
    vp = view.ActiveViewport
    size = System.Drawing.Size(vp.Size.Width*scaleFactor,vp.Size.Height*scaleFactor)
    capture = view.CaptureToBitmap(size)
    capture.Save(filePath);


export_dir = os.path.join(DATA, 'parameter_studies')
if not os.path.isdir(export_dir): os.mkdir(export_dir)
print export_dir
filename = os.path.join(export_dir, 'capture_' + str(idx) + '.png') 
print filename

zoom = 1

if capture:
    rCommonCap(filename, viewport_name, zoom)
# ---------- end capture_to_bitmap ----------

# ----
# 01 - CEM Model
series = Series(Start=0, Step=expr("1/(x-2)", l_int), Count=expr("x-1", l_int))
graph_mapper = GraphMapper(
    series,
    x0=0,
    x1=1,
    y0=0,
    y1=1,
    container_name="Bezier",
    cpx=[0, 0.4604810774, 1, 1],
    cpy=[0.1269744635, 0.1277402639, 0.5032821894, 1])
construct_domain = ConstructDomain(DomainStart=number_slider, DomainEnd=Slider(-5, range=-100..100))
remap_numbers = RemapNumbers(Value=graph_mapper, Source=Domain(0, 1), Target=construct_domain)  # -> graft(Mapped), Clipped
repeat_data = RepeatData(Data=remap_numbers.Mapped, Length=res_int)  # -> flatten(Data)
cem_deviation = CEM_Deviation(DeviationEdge=tp.Dt, DeviationMagn=number_slider)
cem_deviation_2 = CEM_Deviation(DeviationEdge=tp.D, DeviationMagn=repeat_data)
cem_load = CEM_Load(PointLoad=tp.N, LoadMagnZ=Slider(-1, range=-100..100))
cem_trail = CEM_Trail(TrailEdge=tp.T, TrailLen=Slider(-0.5, range=-100..100))
cem_support = CEM_Support(Support=tp.S)
cem_build_topology = CEM_Build_Topology(T=flatten(cem_trail), L=cem_load, D=flatten([cem_deviation, cem_deviation_2]), S=flatten(cem_support))
cem_extract_topology = CEM_Extract_Topology(TP=cem_build_topology)  # -> Nodes, NodesID, Edges, EdgesID, ConstraintPlane, ConstraintPlaneID, OriginNode, OriginNodeID
cem_origin_node = CEM_Origin_Node(OriginNode=cem_extract_topology.OriginNode, OriginNodeID=cem_extract_topology.OriginNodeID)
cem_calculate_structure = CEM_Calculate_Structure(TP=cem_build_topology, N=cem_origin_node)
cem_extract_structure = CEM_Extract_Structure(M=cem_calculate_structure)  # -> Nodes, NodesID, Trails, TrailsID, TrailsCol, TrailsMag, Deviations, DeviationsID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
end_points = EndPoints(Curve=cem_extract_structure.ExternalForces)  # -> Start, End
scale = Scale(Geometry=cem_extract_structure.ExternalForces, Center=end_points.Start, Factor=0.25)  # -> Geometry, Transform

# ----
# 02 - Mesh model
join_curves = JoinCurves(Curves=cem_extract_structure.Deviations, Preserve=False)
construct_point = ConstructPoint(XCoordinate=100, YCoordinate=0, ZCoordinate=0)
curve_closest_point = CurveClosestPoint(Point=construct_point, Curve=join_curves)  # -> Point, Parameter, Distance
deconstruct = Deconstruct(Point=curve_closest_point.Point)  # -> XComponent, YComponent, ZComponent
seam = Seam(Curve=flatten(join_curves), Seam=flatten(curve_closest_point.Parameter))
sort_list = SortList(Keys=deconstruct.ZComponent, ValuesValuesA=seam)  # -> Keys, ValuesValuesA
mesh_2 = GhPythonScript(C=sort_list.ValuesValuesA)  # -> M; inputs C: list of Curve
# ---------- mesh_2: Python ----------
import ghpythonlib.components as gh

M = []

for i in range(len(C)-1):
    
    cp_a = gh.ControlPoints(C[i])[0]
    cp_b = gh.ControlPoints(C[i+1])[0]
    
    for k in range(len(cp_a)-1):
        
        mloc = gh.ConstructMesh([cp_a[k], cp_a[k+1], cp_b[k+1], cp_b[k]], 'Q{0;1;2;3}')
        M.append(mloc)

M = gh.MeshJoin(M)
# ---------- end mesh_2 ----------
deconstruct_box = DeconstructBox(Box=mesh_2)  # -> Plane, X, Y, Z
unit_z = UnitZ(Factor=deconstruct_box.Z)
move = Move(Geometry=mesh_2, Motion=unit_z)  # -> Geometry, Transform
custom_preview_2 = CustomPreview(Geometry=move.Geometry, Material=ColourSwatch(SwatchColor=RGBA(76, 76, 76, 44)))

move_2 = Move(Geometry=flatten([cem_extract_structure.Trails, cem_extract_structure.Deviations]), Motion=unit_z)  # -> Geometry, Transform
move_3 = Move(Geometry=flatten(scale.Geometry), Motion=unit_z)  # -> Geometry, Transform
custom_preview_3 = CustomPreview(Geometry=move_2.Geometry, Material=[cem_extract_structure.TrailsCol, cem_extract_structure.DeviationsCol])
custom_preview_4 = CustomPreview(Geometry=move_3.Geometry, Material=cem_extract_structure.ExternalForcesCol)

# ----
# Assembly visualization
# 1. Visualize assembly.
# 2. Visualize selected option.
# 3. Visuilize current options (all/filtered).
# Preview Mode
list_6 = ValueList({"'Built by Human/Robot'": 0, "'Design Generation'": 1, "'Assembly Workflow'": 2}, selected="'Design Generation'")
show_4 = BooleanToggle(True)
show_5 = BooleanToggle(False)
show_6 = BooleanToggle(False)
show_7 = BooleanToggle(True)
show_8 = BooleanToggle(False)
show_9 = BooleanToggle(False)
show_10 = BooleanToggle(True)
show_11 = BooleanToggle(False)
show_12 = BooleanToggle(False)
number_slider_4 = Slider(42, range=0..360)  # disabled

# ----
# User inputs
colour_swatch_2 = ColourSwatch(SwatchColor=RGBA(255, 13, 0, 103))

# ----
# Add elements
add = Button()
update = GhPythonScript(trigger=[join_branches, add])  # -> update; inputs trigger: list
# ---------- update: Python ----------
update = False

for value in trigger:
    if value:
        update = True

print update
# ---------- end update ----------

settings_parameters = GhPythonScript(
    assembly=initial_configuration.assembly,
    mode=list_5,
    next_element=next,
    prev_element=previous,
    get_key_by_index=get_key_by_index,
    key_at_index=key_at_index,
    selected_angle=angle,
    selected_shift_value=shift_value,
    filter_keys=filter_keys,
    close_connector=close_connector,
    flip_human_robot=flip_human_robot,
    reset_key=reset_key,
    compute=compute,
    random_options_num=options_num,
    generate_random_key=random_key,
    target_geo=guiding_geo,
    support_geo=support_geo,
    distance_weight=distance_weight,
    angle_weight=angle_weight,
    robot1_base_plane=mobile_robot_1_base_plane,
    robot2_base_plane=mobile_robot_2_base_plane,
    stability_criteria=list_4,
    show_resultant=show_resultant,
    collision=collision,
    reset_key_2=reset_key,
    update=update)  # -> out, assembly, selected_mode, current_key, current_angle, current_shift_value, is_colliding, stability_feedback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; inputs key_at_index: Int32, random_options_num: Int32, generate_random_key: Boolean, target_geo: Mesh, support_geo: Brep, robot1_base_plane: Plane, robot2_base_plane: Plane
# ---------- settings_parameters: Python ----------
import math
import random
import System.Threading.Tasks as tasks
from scriptcontext import sticky as st
import Rhino.Geometry as rg
import rhinoscriptsyntax as rs

import ghpythonlib.components as ghcomp

from compas.geometry import Frame, Box, Point, Plane
from compas.geometry import Vector, Translation, angle_vectors, Rotation
from compas.artists import Artist
from compas.topology import connected_components

import time

all_options = []
distances = []
vectors = []
origins = []
filtered_keys = []

stability_check = {0:'global', 1:'local', 2:'no_stability_check'}
assembly.stability_check = stability_check[stability_criteria]
assembly.support = support_geo
assembly.target_geo = target_geo

flip = 'AA'

fitness_table = []

shift = 0
set_random_shift = False
parallel = True
only_grow_top = True
top_keys = 30
iterations = 1


def get_key(open_keys):
    #if not generate_random_key:
    if selected_key in open_keys and not generate_random_key:
        random_key = selected_key
    else:
        random_key = random.choice(open_keys)
    return random_key


def generate_option(support_centroid, fitness_table, open_keys, cp=None):
    # The calculation order was adapted to the ratio of elements which do not pass the tests. There is a high properbility that the output value test is failed.
    # Therefore, this test is perofrmed first and we immeditely return if it failed and do not do any further calculations.
    
    # pick a key
    option_key = get_key(open_keys)
    # generate a random angle and shift
    random_angle = random.randint(0, 90) * 4
    random_shift = shift if not set_random_shift else random.uniform(-0.04, 0.04)

    # get the current option elements of the random key with the given flip, angle, and shift
    random_option_elems = assembly.element(option_key).current_option_elements(flip, random_angle, random_shift)

    # calculate the orientation to the target geometry and the distance to the target geometry
    output_value, vector1 = assembly.orientation_to_target_geo(option_key, random_angle,
                                                               assembly.target_geo)

    if not output_value > 80.0:
        return

    # check if the random option elements collide with anything
    if assembly.collision_check(random_option_elems, tolerance=-0.001):
        return

    # check if all the random option elements are away from the ground
    random_elems_frames = [element.frame for element in random_option_elems]
    if not all(frame.point.z > 0.2 for frame in random_elems_frames):
        return

    distance, vector2 = assembly.distance_to_target_geo(option_key, random_angle, assembly.target_geo)

    if not distance < 0.3:
        return

    if assembly.stability_check == 'global':
        # calculate global equilibrium and the resultant force of the random option elements
        global_equilibrium, resultant, msg = assembly.calculate_global_equilibrium(assembly.support,
                                                                                   random_option_elems, radius=0.01)

        if not global_equilibrium:
            return

        # calculate the distance between the resultant force and the surface area centroid of the support
        dist = rs.Distance(rs.CurveEndPoint(resultant), support_centroid)

        # calculate the score of the random option elements
        score = output_value * angle_weight + distance * distance_weight + 1 / dist

    elif assembly.stability_check == 'local':
        cp_with_random = cp + [Artist(random_option_elem.line.midpoint).draw() for random_option_elem in
                               random_option_elems]
        sp = [Artist(assembly.element(0).line.end).draw()]

        # calculate local equilibrium (level arm) and the resultant point of the random option elements
        lever_arm, resultant_point = assembly.calculate_local_equilibrium_in_a_branch(cp_with_random, sp,
                                                                          assembly.globals['rod_length'],
                                                                          assembly.globals['rod_radius'])

        score = output_value * angle_weight + 1 / distance * distance_weight + 1 / lever_arm[0]

    elif assembly.stability_check == 'no_stability_check':
        score = output_value * angle_weight + 1 / distance * distance_weight

    # create a fitness table the random values and corresponding scores
    fitness_table.append([option_key, random_angle, random_shift, score])

def get_option_with_highest_score():
    computed_values = []
    msgs = []
    if assembly.stability_check == 'local':
        cp = [Artist(assembly.element(bkey).line.midpoint).draw() for bkey, element in assembly.elements()]
    else:
        cp = None

    start_time_loop = time.time()  # timestamp

    for i in range(iterations):
        fitness_table = []
        # precompute the keys of open connectors
        #open_keys = [key for key, frames in assembly.connectors('open') if frames != []]
        open_keys = assembly.open_connectors_keys
        
        
        # To ensure that the algorithm does not lose efficiency when growing along a geometry due to the increasing options, we only choose between the top keys
        if len(open_keys) > top_keys:
            open_keys = open_keys[len(open_keys)-top_keys:]
            
        print open_keys

        # precompute the surface area centroid of the support
        support_centroid = rs.SurfaceAreaCentroid(assembly.support)[0]

        # Here we leverage multiple cores at once. If the computer has more then one core this speeds of significantly
        if parallel:
            print 'yes'
#            tasks.Parallel.ForEach(xrange(random_options_num), lambda i: generate_option(support_centroid, fitness_table, open_keys, cp=cp))
#        else:
            for i in range(random_options_num):
                generate_option(support_centroid, fitness_table, open_keys, cp=cp)

        fitness_table_sorted = sorted(fitness_table, key=lambda x: x[3], reverse=True)
        
        msgs.append('{}. ITERATION:'.format(i))

        if fitness_table_sorted:
            msgs.append(
                'Element key {} with the highest score: {}'.format(fitness_table_sorted[0][0], fitness_table_sorted[0][3]))

            best_key = fitness_table_sorted[0][0]
            best_angle = fitness_table_sorted[0][1]
            best_shift_value = fitness_table_sorted[0][2]

            computed_values = {'key': best_key, 'angle': best_angle, 'shift_value': best_shift_value}
            
        else:
            msgs.append('No elements found which fit to the assembly. Increase the number of options or try finding a fit manually.')
    print("--- Total time %s seconds ---" % (time.time() - start_time_loop))
    # print the messages
    for msg in msgs:
        print(msg)
    
    return computed_values

# all keys
key_index = assembly.network.key_index()
keys = [key_index[key] for key in assembly.network.nodes()]
all_elements = [assembly.element(key) for key in keys]

#############################################################################
## ALL OPEN CONNECTORS KEYS
#############################################################################

open_connectors_keys = [key for key, frames in assembly.connectors(state='open')]

assembly.open_connectors_keys = open_connectors_keys

#############################################################################
## SELECT A KEY MANUALLY
#############################################################################

guid = str(ghenv.Component.InstanceGuid)
element_key = "elem_" + guid

if element_key not in st or None:
    st[element_key] = 0

if reset_key:
    st[element_key] = 0

if next_element:
    if st[element_key] < len(open_connectors_keys) - 1:
        st[element_key] += 1

if prev_element:
    if st[element_key] <= len(open_connectors_keys) - 1:
        st[element_key] -= 1

    if st[element_key] < 1:
        st[element_key] = 0

#############################################################################
## OPEN CONNECTORS
#############################################################################

if not get_key_by_index and mode == 0:
    if len(open_connectors_keys) == 0: 
        #selected_key = 0
        print("!!! NO OPEN CONNECTORS AVAILABLE !!!")
        print("Suggestion: RESET KEY!")
        
    elif len(open_connectors_keys) > 0:
        if st[element_key] in keys:
            selected_key = open_connectors_keys[st[element_key]]

if get_key_by_index and mode == 0:
    selected_key = key_at_index
    
if mode == 1:
    selected_key = open_connectors_keys[st[element_key]]
    
if 'selected_key' in locals():
    print "Selected key:", selected_key


#############################################################################
## GET PARAMETERS
#############################################################################
params = 'params'

if params not in st or st['params'] is None:
    st[params] = {'key' : selected_key, 'angle': 0, 'shift_value': 0}

selected_mode = "Manual" if mode == 0 else "Automatic" if mode == 1 else "Join branches"

if mode == 1 and compute:
    st[params] = get_option_with_highest_score()
elif mode == 0:
    st[params] = {'key' : selected_key, 'angle': selected_angle, 'shift_value': selected_shift_value}

parameters = st[params]

print 'Current parameters:', parameters 

current_key = parameters['key']
current_angle = parameters['angle']
current_shift_value = parameters['shift_value']

print 'Current key:', current_key

if current_key != None:
    selected_elem = assembly.network.node[current_key]['element']

assembly.parameters = parameters
#try:
#   .... use of selected_key....
#expect:
#   print("selected_key does not exist, but no problem.)
#   

#############################################################################
## DISPLAY SELECTED CONNECTOR
#############################################################################

if current_key != None:
    
    selected_connector_frame = assembly.element(current_key).connectors(state='open')[0]
    #selected_connector_frame

    R = Rotation.from_axis_and_angle(selected_elem.frame.xaxis, math.radians(current_angle), selected_elem.frame.point)
    T = Translation.from_vector(selected_elem.frame.xaxis * selected_shift_value)
    
    selected_connector_frame_copy = selected_connector_frame.transformed(R)
    selected_connector_frame_copy.transform(T)
    selected_connector_plane = Artist(selected_connector_frame_copy).draw()
    
    elem_options = assembly.element(current_key).current_option_elements(flip, current_angle, current_shift_value)

#############################################################################
## COLLISION CHECK
#############################################################################

# check if the selected option elements collide with anything
is_colliding = assembly.collision_check(elem_options, tolerance = -0.001) if collision else False


#############################################################################
## GLOBAL/LOCAL EQUILIBRIUM CHECK
#############################################################################

lever_arm_branches = []
resultant_branches = []
resultant = []

if stability_criteria == 0:
    # calculate global equilibrium and the resultant force of the selected option elements
    equlibrium, resultant_line, stability_feedback = assembly.calculate_global_equilibrium(support_geo, elem_options, radius=0.01)
    resultant_line = rs.coercecurve(resultant_line)    
    print resultant_line
    
elif stability_criteria == 1:
    
    # Identify the connected elements (branches) in the assembly.
    branches = connected_components(assembly.network.adjacency)
    
    stability_feedback = []

    lever_arm_branches, resultant_branches = assembly.calculate_local_equilibrium_in_all_branches(current_key, elem_options)
    
    for i, lever_arm in enumerate(lever_arm_branches):
        stability_feedback.append("Lever arm of branch {} is {len:.3f}m long.".format(i, len=float(lever_arm)))
else:
    stability_feedback = "No stability criteria selected."
    
#print lever_arm_branches
#print resultant_branches

if show_resultant:
    if stability_criteria == 0:
        cone_base_plane = rg.Plane(resultant_line.PointAt(0), rg.Vector3d.ZAxis*-1)
        resultant.append(rg.Cone(cone_base_plane,-0.4, 0.02))
    else:
        for resultant_line, lever_arm in zip(resultant_branches, lever_arm_branches):
            cone_base_plane = rg.Plane(resultant_line.PointAt(0), rg.Vector3d.ZAxis*-1)
            resultant.append(rg.Cone(cone_base_plane,-lever_arm, 0.02))


#############################################################################
## DISTANCE TO INPUT GEO
#############################################################################

distance, shortest_vector_1 = assembly.distance_to_target_geo(current_key, current_angle, target_geo)

# Vector Display
vectors.append(shortest_vector_1)
origins.append(selected_connector_plane.Origin)

target_geo_feedback = ['Key {}: Distance to target geometry: {dist:.2f}m'. format(current_key, dist=distance)]

#############################################################################
## ORIENTATION TO INPUT GEO
#############################################################################

output_value, shortest_vector_2 = assembly.orientation_to_target_geo(current_key, current_angle, target_geo)

# Vector Dispaly
vectors.append(rg.Vector3d(shortest_vector_2.x,shortest_vector_2.y,shortest_vector_2.z))
origins.append(selected_connector_plane.Origin)

target_geo_feedback.append('Key {}: Orientation to target geometry: {len:.2f}%'. format(current_key, len=output_value))

#############################################################################
## LAST ADDED KEYS
#############################################################################

new_keys = keys[-2:]
assembly.last_added = new_keys
print 'Last added keys:', ', '.join(map(str, new_keys))

#############################################################################
## Close connector
#############################################################################

if close_connector:
    assembly.element(key_at_index).connector_1_state = False
    assembly.element(key_at_index).connector_2_state = False

#############################################################################
## Filter key according to current robot location
#############################################################################

robot1_plane = robot1_base_plane.Clone()
robot2_plane = robot2_base_plane.Clone()

robot1_plane.Translate(robot1_plane.ZAxis*1.02)
robot2_plane.Translate(robot2_plane.ZAxis*1.02)

assembly.robot1_plane = robot1_plane
assembly.robot2_plane = robot2_plane

r1_p = robot1_plane.Origin 
r2_p = robot2_plane.Origin


if filter_keys:
    for key, element in assembly.elements():
        if key in open_connectors_keys:
            distance1 = element.frame.point.distance_to_point(r1_p)
            distance2 = element.frame.point.distance_to_point(r2_p)
    #        print distance1, key
    #        print distance2, key
            if distance1 < 1.25 or distance2 < 1.25:
                filtered_keys.append(key)
    assembly.open_connectors_keys = filtered_keys
# ---------- end settings_parameters ----------
pln_4 = Plane(settings_parameters.robot2_plane)
pln_5 = Plane(settings_parameters.robot1_plane)
srf = Surface(settings_parameters.resultant)
vdis = VectorDisplay(Anchor=settings_parameters.origins, Vector=settings_parameters.vectors)
preview = CustomPreview(Geometry=srf, Material=colour_swatch_2)

# ----
# Joining branches
joining_branches = GhPythonScript(
    assembly=settings_parameters.assembly,
    elem=elem_def.elem,
    get_joining_options=get_joining_options,
    joining_case=list_3,
    show_new_element=show_new_element,
    pair_index=pair_index,
    point_on_intersection=number_slider_2,
    point1=point1,
    point2=point2,
    shift_value=shift_value_2,
    join_branches=join_branches)  # -> out, assembly, elem_line1, elem_line2, new_elem_mesh, intersections, angle1, angle2; inputs pair_index: Int32
# ---------- joining_branches: Python ----------
import math
import rhinoscriptsyntax as rs
import Rhino.Geometry as rg

from compas.geometry import Point, Vector, Frame, Plane, Vector, Line, Transformation, Rotation, Translation
from compas.geometry import angle_vectors, closest_point_on_line, intersection_line_plane, angles_points
from compas.artists import Artist
from compas_rhino.conversions import line_to_rhino_curve, point_to_compas, point_to_rhino, plane_to_compas_frame

import ghpythonlib.components as gh



connector_ranges = []
connectors_pairs = []
intersections = []

flip = 'AA'
epsilon = 0.0000001

open_connectors_keys = [key for key, frames in assembly.connectors(state='open')]

RCF1 = plane_to_compas_frame(assembly.robot1_plane)
RCF2 = plane_to_compas_frame(assembly.robot2_plane)

#############################################################################
## CASE 1
#############################################################################

if get_joining_options and joining_case == 0:

    for key, connector_range in assembly.connectors_ranges(state='open'):
        if len(connector_range) != 0:
            connector_ranges.append((key, Artist(connector_range[0]).draw()))

    for i in range(len(connector_ranges)):
        for open_connectors_key in open_connectors_keys:
            intersection = rg.Intersect.Intersection.CurveSurface(line_to_rhino_curve(assembly.element(open_connectors_key).line), connector_ranges[i][1], 0.001, 0.001)
            if intersection:
                for c in intersection:
                    intersections.append(c.PointA)
                connectors_pairs.append((connector_ranges[i][0], open_connectors_key))

    #print len(intersection_curves)

    if len(connectors_pairs) != 0:
        intersection_point = intersections[pair_index]
        selected_keys_pair = [pkey for pkey in connectors_pairs[pair_index]]
        connectors_pairs_list = [key for pair in connectors_pairs for key in pair]
    
        assembly.selected_keys_pair = [selected_keys_pair[0]]
        assembly.connectors_pairs_list = connectors_pairs_list
        assembly.selected_connectors_ranges_intersection_point = intersection_point
        
        # Convert in COMPAS Point
        cp = point_to_compas(intersection_point)
        
        # Compute angle for option pair
        open_connector_elem_1 = assembly.element(selected_keys_pair[0])
        cutting_plane_origin_1 = closest_point_on_line(cp, open_connector_elem_1.line)
        cutting_plane_1 = Plane(cutting_plane_origin_1, open_connector_elem_1.line.vector)
        intersection_point_1 = intersection_line_plane(open_connector_elem_1.current_option_elements(flip, 0, 0)[1].line, cutting_plane_1)

        angle1 = angles_points(cutting_plane_origin_1, intersection_point_1, cp) 
        angle1 = math.degrees(angle1[0])
        
        current_option = assembly.element(selected_keys_pair[0]).current_option_elements(flip, angle1, 0)

        rot_line = Artist(assembly.element(selected_keys_pair[0]).line).draw()
        start_p = rot_line.From
        rot_axis = rg.Vector3d(rot_line.From - rot_line.To)
        rot_point = Artist(assembly.element(selected_keys_pair[0]).frame.point).draw()
        elem_line1 = Artist(current_option[1].line).draw()
        elem_line2 = Artist(assembly.element(selected_keys_pair[1]).line).draw()
        rot_dir = 1
        step = 1.0

        tol_angle = assembly.get_rot_angle(step, rot_axis, rot_point, elem_line1, elem_line2, rot_dir, epsilon)
        angle1 += tol_angle
        
        current_option_rotated = assembly.element(selected_keys_pair[0]).current_option_elements(flip, angle1, 0)
        
        if show_new_element:
            new_elem = assembly.add_third_element(elem, assembly.element(selected_keys_pair[1]), current_option_rotated[1], point1, point2, shift_value, epsilon)
            new_elem_mesh = Artist(new_elem.mesh).draw()
        
        if join_branches:
            msgs = []
            
            # close a reciprocal frame unit with the option elements with the highest score
            assembly.join_branches(selected_keys_pair, flip, angle1, 0, new_elem, RCF=RCF1, on_ground=False, added_frame_id=None, frame_est=None)

            msgs.append('--- New element added to assembly ---')
            
            for msg in msgs:
                print(msg)
    else:
        assembly.selected_keys_pair = []
        assembly.connectors_pairs_list = []
        assembly.selected_connectors_ranges_intersection_point = []
        
#############################################################################
## CASE 2
#############################################################################

if get_joining_options and joining_case == 1:
    for key, connector_range in assembly.connectors_ranges(state='open'):
        if len(connector_range) != 0:
            #print connector_range
            connector_ranges.append((key, Artist(connector_range[0]).draw()))

    for i in range(len(connector_ranges)):
        for j in range(i + 1, len(connector_ranges)):
            is_intersecting, intersection, p_array = rg.Intersect.Intersection.SurfaceSurface(connector_ranges[i][1], connector_ranges[j][1], 0.001)
            if len(intersection) > 0:
                #print intersection
                joined_curve = rg.Curve.JoinCurves(intersection)
                connectors_pairs.append((connector_ranges[i][0], connector_ranges[j][0]))
                #print joined_curve
                intersections.append(joined_curve[0])
                
        
    #print 'Following element pair(s) {} could be joined.'.format(connectors_pairs)
    #print intersections
    
    if len(connectors_pairs) != 0:
        curve_param = intersections[pair_index].NormalizedLengthParameter(point_on_intersection)
        intersection_point = intersections[pair_index].PointAt(curve_param[1])
        
        selected_keys_pair = [pkey for pkey in connectors_pairs[pair_index]]
        connectors_pairs_list = [key for pair in connectors_pairs for key in pair]
    
        assembly.selected_keys_pair = selected_keys_pair
        assembly.connectors_pairs_list = connectors_pairs_list
        assembly.selected_connectors_ranges_intersection_point = intersection_point

        # Convert to compas point
        cp = point_to_compas(intersection_point)
        
        # Compute angle for first option pair
        open_connector_elem1 = assembly.element(selected_keys_pair[0])
        cutting_plane_origin1 = closest_point_on_line(cp, open_connector_elem1.line)
        cutting_plane1 = Plane(cutting_plane_origin1, open_connector_elem1.line.vector)
        option_elem1 = open_connector_elem1.current_option_elements(flip, 0, 0)[1]
        intersection_point1 = intersection_line_plane(option_elem1.line, cutting_plane1)
        
        angle1 = angles_points(cutting_plane_origin1, intersection_point1, cp) 
        angle1 = math.degrees(angle1[0])
        
        # Compute angle for second option pair
        open_connector_elem2 = assembly.element(selected_keys_pair[1])
        cutting_plane_origin2 = closest_point_on_line(cp, open_connector_elem2.line)
        cutting_plane2 = Plane(cutting_plane_origin2, open_connector_elem2.line.vector)
        option_elem2 = open_connector_elem2.current_option_elements(flip, 0, 0)[1]
        intersection_point2 = intersection_line_plane(option_elem2.line, cutting_plane2)
        
        angle2 = angles_points(cutting_plane_origin2, intersection_point2, cp)
        angle2 = math.degrees(angle2[0])
        
        rot_line = Artist(open_connector_elem1.line).draw()
        start_p = rot_line.From
        rot_axis = rg.Vector3d(rot_line.From - rot_line.To)
        rot_point = Artist(assembly.element(selected_keys_pair[0]).frame.point).draw()
        elem_line1 = Artist(option_elem1.line).draw()
        elem_line2 = Artist(option_elem2.line).draw()

        rot_dir = 1
        step = 6.0

        tol_angle = assembly.get_rot_angle(step, rot_axis, rot_point, elem_line1, elem_line2, rot_dir, epsilon)
        angle1 += tol_angle
        
        option1_rotated = assembly.element(selected_keys_pair[0]).current_option_elements(flip, angle1, 0)
        option2_rotated = assembly.element(selected_keys_pair[1]).current_option_elements(flip, angle2, 0)
        
        if show_new_element:
            new_elem = assembly.add_third_element(elem, option1_rotated[1], option2_rotated[1], point1, point2, shift_value, epsilon)
            new_elem_mesh = Artist(new_elem.mesh).draw()

if not get_joining_options:
    assembly.selected_keys_pair = []
    assembly.connectors_pairs_list = []
    assembly.selected_connectors_ranges_intersection_point = []


if joining_case == 0:
    print '-------------- CASE 1: SINGLE OPTIONS-PAIR -------------'
elif joining_case == 1:
    print '-------------- CASE 2: TWO OPTIONS-PAIRS ---------------'
print 'Number of key-pairs that can be joined:', len(connectors_pairs)
print 'Selected open connectors key-pair:', assembly.selected_keys_pair
if len(assembly.selected_keys_pair) != 0:
    print 'Open connector key for option:', assembly.selected_keys_pair[0]
print 'Option 1 angle:', angle1
print 'Option 2 angle:', angle2
# ---------- end joining_branches ----------
line = Line(joining_branches.elem_line2)
crv = Curve(joining_branches.intersections)
line_2 = Line(joining_branches.elem_line1)
mesh_3 = Mesh(joining_branches.new_elem_mesh)

pln_6 = Plane(settings_parameters.selected_connector_plane)

stats = GhPythonScript(assembly=settings_parameters.assembly)  # -> out
# ---------- stats: Python ----------
from compas.topology import connected_components


# Identify the connected elements (branches) in the assembly.
branches = connected_components(assembly.network.adjacency)

print '-------------------- ASSEMBLY --------------------'
print 'The assembly has {} branches.'.format(len(branches))

total_elements = assembly.network.number_of_nodes()
planned_keys = list(assembly.network.nodes_where({'is_planned':True}))
built_keys = list(assembly.network.nodes_where({'is_built':True}))
support_keys = list(assembly.network.nodes_where({'is_support':True}))

print '-------------------- ELEMENTS --------------------'
print total_elements, "element(s) in assembly."
print len(built_keys), "element(s) are already built."
print len(planned_keys), "element(s) are planned."
print len(support_keys), "element(s) are suppports."

keys = [key for key, element in assembly.elements()]
open_connectors_keys = [key for key in keys if assembly.element(key).connectors(state='open')]
closed_connectors_keys = [key for key in keys if key not in open_connectors_keys]

print '------------------- CONNECTORS -------------------'
print len(open_connectors_keys), 'open connectors'
print len(closed_connectors_keys), 'closed connectors'

edges = assembly.network.number_of_edges()
nodes = len(closed_connectors_keys)*3

print '--------------------- NODES ----------------------'

print nodes, 'nodes (rough estimation)'
print 'approx. elements:nodes ration  1:1,5'
# ---------- end stats ----------
numbers = Panel(stats)

# ----
# Current parameters
key = Panel(settings_parameters.current_key)
angle_2 = Panel(settings_parameters.current_angle)
shift_value_3 = Panel(settings_parameters.current_shift_value)

# ----
# Feedback
collision_detection = Panel(settings_parameters.is_colliding)
stability_feedback = Panel(settings_parameters.stability_feedback)
target_geometry = Panel(settings_parameters.target_geo_feedback)
joining_branches_2 = Panel(joining_branches.out)

# ----
# Status bar
# Current mode
panel_4 = Panel(settings_parameters.selected_mode)

grow_assembly = GhPythonScript(
    assembly=joining_branches.assembly,
    key=settings_parameters.current_key,
    angle=settings_parameters.current_angle,
    shift_value=settings_parameters.current_shift_value,
    add=add)  # -> out, assembly
# ---------- grow_assembly: Python ----------
from compas_rhino.conversions import plane_to_compas_frame

flip = 'AA'

RCF1 = plane_to_compas_frame(assembly.robot1_plane)
RCF2 = plane_to_compas_frame(assembly.robot2_plane)

#############################################################################
## ADD ELEMENTS TO ASSEMBLY BY SELECTED  KEY, ANGLE AND SHIFT_VALUE
#############################################################################


if add:
    msgs = []
    
    # close a reciprocal frame unit with the option elements with the highest score
    assembly.close_rf_unit(key, flip, angle, shift_value, RCF1, on_ground=False)
    
    msgs.append('--- New element added to assembly ---')
    
    for msg in msgs:
        print(msg)


#for key, element in assembly.elements():
#    print assembly.network.node_attribute(key, 'RCF')
# ---------- end grow_assembly ----------
rec = DataRecorder(grow_assembly.out, DataLimit=-10, RecordData=False)
messages = Panel(rec)

# ----
# Network visualization
number_slider_5 = Slider(0, range=0..47)
show_13 = BooleanToggle(False)
network_viz = GhPythonScript(assembly=settings_parameters.assembly, show_network=show_13, key=number_slider_5)  # -> out, nodes, edges, current_node, current_node_neighbors; inputs key: Int32
# ---------- network_viz: Python ----------
import sys, os
import ghpythonlib.components as ghcomp
from compas.datastructures import Network
from compas_ghpython.artists import NetworkArtist
from compas_rhino.geometry import RhinoLine

import compas_ghpython
import Rhino.Geometry as rg


data = assembly.network.to_data()
network = Network.from_data(data)

print assembly.network.number_of_nodes()

def draw_network(network):
    """Draw a network in Grasshopper.
    """
    points = []
    for key, attr in network.nodes(True):
        points.append({
            'pos': network.node_coordinates(key),
        })

    lines = []
    for (u, v), attr in network.edges(True):
        lines.append({
            'start': network.node_coordinates(u),
            'end': network.node_coordinates(v),
        })

    points_rg = compas_ghpython.draw_points(points)
    lines_rg = compas_ghpython.draw_lines(lines)

    return points_rg, lines_rg

if show_network:
    nodes, edges = draw_network(network)
    
    current_node = {'pos': network.node_coordinates(key), 'radius': 0.03}
    current_node = compas_ghpython.draw_spheres([current_node])
    
    current_node_neighbors_keys = network.neighbors(key)
    current_node_neighbors = [{'pos': network.node_coordinates(key), 'radius': 0.02} for key in current_node_neighbors_keys]
    current_node_neighbors = compas_ghpython.draw_spheres(current_node_neighbors)
# ---------- end network_viz ----------
pt_3 = Point(network_viz.nodes)
line_3 = Line(network_viz.edges)
brep_4 = Brep(network_viz.current_node)
brep_5 = Brep(network_viz.current_node_neighbors)
preview_2 = CustomPreview(Geometry=brep_5, Material=ColourSwatch(SwatchColor=RGB(255, 207, 207)))
preview_3 = CustomPreview(Geometry=[brep_4, line_3], Material=ColourSwatch(SwatchColor=RGB(0, 0, 0)))

# ----
# Set to built
keys = Slider(18, range=0..100)
set_to_built = GhPythonScript(assembly=grow_assembly.assembly, built_keys=keys, set_keys_to_built=Button(), set_all_to_unbuilt=Button())  # -> out, assembly; inputs built_keys: Int32
# ---------- set_to_built: Python ----------
import rhinoscriptsyntax as rs

if set_keys_to_built:
    for i in range(built_keys):
        #assembly.network.node_attribute(i, 'is_planned', True)
        assembly.network.node_attribute(i, 'is_built', True)
        
if set_all_to_unbuilt:
    for key, element in assembly.elements():
    #    assembly.network.node_attribute(key, 'is_planned', True)
        assembly.network.node_attribute(key, 'is_built', False)
# ---------- end set_to_built ----------

assembly_viz = PythonScript(
    assembly=set_to_built.assembly,
    preview_mode=list_6,
    show_assembly=show_4,
    show_robots_reach=show_5,
    show_support=show_6,
    show_option=show_7,
    show_open_connectors_planes=show_8,
    show_selected_connectors_ranges=show_3,
    show_all_connectors_ranges=show_9,
    show_intersection=show_10,
    show_joining_options=get_joining_options,
    show_open_keys=show_11,
    show_all_keys=show_12,
    current_key=settings_parameters.current_key,
    angle=settings_parameters.current_angle,
    angle1=joining_branches.angle1,
    angle2=joining_branches.angle2,
    shift_value=settings_parameters.current_shift_value,
    flip_human_robot=flip_human_robot)  # -> out, G_planned_elems, G_built_elems, G_placed_by_human, G_placed_by_robot, G_support_elems, G_no_open_connectors_elems, G_open_connectors_elems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; inputs current_key: Int32
# ---------- assembly_viz: Python ----------
import os
import sys
from scriptcontext import sticky as st
import Rhino.Geometry as rg

import math
from math import pi

from compas.geometry import Vector, Translation, Frame
from compas.artists import Artist
from compas.colors import Color
from compas_rhino.conversions import cylinder_to_rhino

G_selected = []

G_placed_by_human = []
G_placed_by_robot = []

G_planned_elems = []
G_built_elems = []
G_support_elems = []

G_no_open_connectors_elems = []
G_open_connectors_elems = []

G_connectors_ranges = []
G_close_pairs = []
G_intersection = []

robots_reach = []
elem_options = []

key_tag_text = []
key_tag_location= []
lines = []

flip = 'AA'

# Color coding
color_coding = {'color_close_pairs': Color(1.0, 0., 0.0, 1.0),
                'color_is_planned': Color(1.0, 0.752941176471, 0.0, 1.0), 
                'color_is_support': Color(0.0, 0.0, 1.0, 1.0), 
                'color_has_open_connector': Color(0.494117647059, 1.0, 0.239215686275, 1.0), 
                'color_has_no_open_connectors': Color(0.78431372549, 0.78431372549, 0.78431372549, 1.0), 
                'color_is_built': Color(0.811764705882, 1.0, 0.709803921569, 1.0), 
                'color_is_built_by_robot': Color(0.686274509804, 0.878431372549, 0.862745098039, 1.0), 
                'color_is_built_by_human': Color(0.949019607843, 0.898039215686, 0.0, 1.0)}

keys = [key for key, element in assembly.elements()]
lines = [Artist(assembly.element(key).line).draw() for key in keys]

open_connectors_frames = [assembly.element(key).connectors(state='open') for key in keys]

selected_element = assembly.element(current_key)

selected_connectors_ranges = [assembly.element(key).connectors_ranges(state='open') for key in keys if key == current_key or key in assembly.selected_keys_pair]
#selected_connectors_ranges = [assembly.element(key).connectors_ranges(state='open') for key in keys if key in assembly.selected_keys_pair]
all_connectors_ranges = [assembly.element(key).connectors_ranges(state='open') for key in keys if key]

if show_open_connectors_planes:
    open_connectors_planes = [Artist(connector).draw() for connectors in open_connectors_frames for connector in connectors if connectors != []]
    
if show_all_connectors_ranges and not show_selected_connectors_ranges:
    G_connectors_ranges = [Artist(connector).draw() for connectors in all_connectors_ranges for connector in connectors if connectors != []]
    
elif show_selected_connectors_ranges and not show_all_connectors_ranges:
    T = Translation.from_vector(selected_element.frame.xaxis * 0)
    connectors_ranges = [connector.transform(T) for connectors in selected_connectors_ranges for connector in connectors if connectors != []]
    G_connectors_ranges = [Artist(connector).draw() for connectors in connectors_ranges]
    
else:
    G_connectors_ranges = []
    
if show_intersection:
    if len(assembly.selected_connectors_ranges_intersection_point) > 0:
        G_intersection = assembly.selected_connectors_ranges_intersection_point
    
def show(element, output_geo, color):
    mesh = Artist(element.mesh).draw(color)
    output_geo.append(mesh)

def show_multiple(elements, output_geo, color):
    for element in elements:
        mesh = Artist(element.mesh).draw(color)
        output_geo.append(mesh)
        
if show_robots_reach:
    robots_reach.append(rg.Sphere(assembly.robot1_plane.Origin, 1.25))
    robots_reach.append(rg.Sphere(assembly.robot2_plane.Origin, 1.25))
    
print assembly.selected_keys_pair

if assembly:
    radius = assembly.globals['rod_radius']
    if current_key != None:
        current_element = assembly.element(current_key)
        if show_joining_options and len(assembly.selected_keys_pair) != 0:
            print 'yes'
            if len(assembly.selected_keys_pair) > 1: 
                elem_options.append(assembly.element(assembly.selected_keys_pair[0]).current_option_elements(flip, angle1, shift_value))
                elem_options.append(assembly.element(assembly.selected_keys_pair[1]).current_option_elements(flip, angle2, shift_value))
            else:
                elem_options.append(assembly.element(assembly.selected_keys_pair[0]).current_option_elements(flip, angle1, shift_value))
            elem_options = [option for options in elem_options for option in options]
        else:
            elem_options = assembly.element(current_key).current_option_elements(flip, angle, shift_value)
        G_selected = Artist(assembly.element(current_key).mesh).draw(color_coding['color_is_support'])
    else:
        current_element = None
        elem_options = []
    
    if len(elem_options) != 0:
        elem_option = elem_options[0]
    
    if flip_human_robot:
        elem_options.reverse()
        
    robot_keys = list(assembly.network.nodes_where({'placed_by':'robot'}))
    human_keys = list(assembly.network.nodes_where({'placed_by':'human'}))
    
    planned_keys = list(assembly.network.nodes_where({'is_planned':True, 'is_built':False}))
    built_keys = list(assembly.network.nodes_where({'is_built':True}))
    
    support_keys = list(assembly.network.nodes_where({'is_support':True}))
    open_connectors_keys = assembly.open_connectors_keys
    no_open_connectors_keys = [key for key in planned_keys if key not in open_connectors_keys]

    #support_keys = [key for key in support_keys if key not in assembly.open_connectors_keys]
    
    print 'robot keys:', robot_keys
    print 'human keys:', human_keys
    
    print 'planned keys:', planned_keys
    print 'built keys:', built_keys
    
    print 'support keys:', support_keys
    print 'open connectors keys:', open_connectors_keys
    print 'no open connectors keys:', no_open_connectors_keys
    
    robot_elements = [assembly.element(key) for key in robot_keys] 
    human_elements = [assembly.element(key) for key in human_keys] 
    
    planned_elements = [assembly.element(key) for key in planned_keys] 
    built_elements = [assembly.element(key) for key in built_keys] 
    
    support_elements = [assembly.element(key) for key in support_keys] 
    open_connectors_elements = [assembly.element(key) for key in open_connectors_keys]
    no_open_connectors_elements = [assembly.element(key) for key in no_open_connectors_keys]
    
    # Visualize assembly
    if show_assembly:
        if preview_mode == 2:
            for element in planned_elements:
                geo = cylinder_to_rhino(element._source)
                G_planned_elems.append(geo)
                
            for element in built_elements:
                geo = cylinder_to_rhino(element._source)
                G_built_elems.append(geo)
                
            for element in support_elements:
                geo = cylinder_to_rhino(element._source)
                #G_support_elems.append(geo)
                
        elif preview_mode == 1:
            for element in support_elements:
                geo = cylinder_to_rhino(element._source)
                G_support_elems.append(geo)
                
            for element in open_connectors_elements:
                geo = cylinder_to_rhino(element._source)
                G_open_connectors_elems.append(geo)
                
            for element in no_open_connectors_elements:
                geo = cylinder_to_rhino(element._source)
                G_no_open_connectors_elems.append(geo)
                
        else:
            for element in robot_elements:
                geo = cylinder_to_rhino(element._source)
                G_placed_by_robot.append(geo)
                
            for element in human_elements:
                geo = cylinder_to_rhino(element._source)
                G_placed_by_human.append(geo)

    # Vizualize current connector 
    if show_option and show_assembly:
        if elem_options:

            for option in elem_options:
                G_planned_elems.append(cylinder_to_rhino(option._source))
                lines.append(Artist(option.line).draw())

        else:
            print('No open connectors')
    
    
    #elem_option_robot = Artist(elem_options[0].frame).draw() # elem for planning robot routine
    
    if show_open_keys:
        for key, element in assembly.elements():
            if key in assembly.open_connectors_keys:
                key_tag_text.append(str(key))
                key_tag_location.append(Artist(element.frame).draw().Origin)
                
    if show_all_keys:
        for key, element in assembly.elements():
            key_tag_text.append(str(key))
            key_tag_location.append(Artist(element.frame).draw().Origin)
            
    if show_support:
        G_supports.append(assembly.support)


points = []
for key, element in assembly.elements():
    points.append(Artist(element.frame.point).draw())
# ---------- end assembly_viz ----------
rot = GhPythonScript(plane=assembly_viz.elem_option_robot, angle=number_slider_4)  # -> out, plane; disabled
# ---------- rot: Python ----------
import math
from compas.geometry import Frame, Rotation
from compas.artists import Artist

frame = Frame(plane.Origin, plane.XAxis, plane.YAxis)

R = Rotation.from_axis_and_angle(frame.xaxis, math.radians(angle), frame.point)
frame.transform(R)

plane = Artist(frame).draw()
# ---------- end rot ----------
geo = Geometry(assembly_viz.G_planned_elems)
pln_7 = Plane(assembly_viz.open_connectors_planes)
tag = TextTag(Location=assembly_viz.key_tag_location, Text=assembly_viz.key_tag_text)
geo_2 = Geometry(assembly_viz.G_built_elems)
geo_3 = Geometry(assembly_viz.G_placed_by_robot)
srf_2 = Surface(assembly_viz.G_connectors_ranges)
mesh_4 = Mesh(assembly_viz.G_close_pairs)
geo_4 = Geometry(assembly_viz.robots_reach)
line_4 = Line(assembly_viz.lines)
geo_5 = Geometry(assembly_viz.G_placed_by_human)
geo_6 = Geometry(assembly_viz.G_support_elems)
geo_7 = Geometry(assembly_viz.G_no_open_connectors_elems)
geo_8 = Geometry(assembly_viz.G_open_connectors_elems)
pt_4 = Point(assembly_viz.points)
pt_5 = Point(assembly_viz.G_intersection)
cir = Circle(Plane=pln_7, Radius=0.2)
sph = Sphere(Base=pt_5, Radius=0.05)
preview_4 = CustomPreview(Geometry=geo_6, Material=ColourSwatch(SwatchColor=RGB(0, 0, 255)))
preview_5 = CustomPreview(Geometry=geo_8, Material=ColourSwatch(SwatchColor=RGB(121, 255, 54)))
preview_6 = CustomPreview(Geometry=geo_4, Material=ColourSwatch(SwatchColor=RGBA(0, 30, 255, 26)))
preview_7 = CustomPreview(Geometry=geo_5, Material=ColourSwatch(SwatchColor=RGB(242, 229, 0)))
preview_8 = CustomPreview(Geometry=geo_3, Material=ColourSwatch(SwatchColor=RGB(175, 224, 220)))
preview_9 = CustomPreview(Geometry=[geo_2, geo_7], Material=ColourSwatch(SwatchColor=RGBA(199, 199, 199, 89)))
preview_10 = CustomPreview(Geometry=geo, Material=ColourSwatch(SwatchColor=RGB(255, 170, 0)))

# ----
# Export .json
panel_5 = Panel("my_design")
export = Button()
export_2 = Button()
export_3 = PythonScript(
    DATA=py.DATA,
    assembly=grow_assembly.assembly,
    project_name=panel_5,
    export_to_json=export,
    export_to_json_unity=export_2)
# ---------- export_3: Python ----------
import os
from compas.datastructures.mesh import mesh_quads_to_triangles
from compas.datastructures.mesh import mesh_unify_cycles
from datetime import datetime

now = datetime.now() # current date and time

if export_to_json:
   # filename = "start_assembly.json"
    date_time = now.strftime("%Y_%m_%d_%H_%M")
    filename = "{}_{}.json".format(date_time, project_name)
    PATH = os.path.join(DATA, "assembly", filename)
    
    # the assembly has to be serialized such that it can be called from CPython, True to enable pretty print
#    for key, element in assembly.elements():
#        #is_built, placed_by  = assembly.network.node_attributes(key, ["is_built", "placed_by"])
#        assembly.network.unset_node_attribute(key, "is_planned")
#        assembly.network.unset_node_attribute(key, "is_support")
#        assembly.network.unset_node_attribute(key, "is_held_by_robot")
#        assembly.network.unset_node_attribute(key, "has_open_connector")
#        assembly.network.unset_node_attribute(key, "color")
#        #assembly.network.node_attribute(key, "is_built", is_built)
#        #assembly.network.node_attribute(key, "placed_by", is_built)
#        
#        assembly.element(key).mesh = None
#        assembly.element(key)._source = None
#        assembly.element(key).connector_frame_1 = None
#        assembly.element(key).connector_frame_2 = None
#        assembly.element(key).connector_range_1 = None
#        assembly.element(key).connector_range_2 = None
#        assembly.element(key).line = None
#        
#        assembly.element(key).connector_1_state = False
#        assembly.element(key).connector_2_state = False
#        
#    assembly.network.node_attribute(0, "is_built", True)
#    assembly.network.node_attribute(1, "is_built", True)
    
    assembly.to_json(PATH, True)
    #assembly.export_to_json_for_xr(PATH, True)
    

if export_to_json_unity:
    
    for key, e in assembly.elements():
    
        #convert to trimesh
        mesh_quads_to_triangles(e._mesh, check_angles=False)
        #mesh_unify_cycles(e._mesh)
        #print e._mesh.faces
        #print e._mesh.face_vertices(list(e._mesh.faces())[0])

    filename = "unity_assembly_test.json"
    PATH = os.path.join(DATA, "assembly", filename)
    assembly.to_json(PATH)
# ---------- end export_3 ----------
