# Grasshopper definition ex4_mobile_robot_model.ghx (Grasshopper 1.0.7)
# plug-ins: CEM_Build_Topology, CEM_Deviation, CEM_Extract_Topology, CEM_Support, CEM_Trail, CEM_Calculate_Structure, CEM_Extract_Structure, CEM_Origin_Node, CEM_Load

r_m = Slider(4, range=0.1..100)
l_int = Slider(15, range=2..100)
res_int = Slider(10, range=4..100)

# ----
# 00 - Input
tp = GhPythonScript(r=r_m, l=l_int, res=res_int)  # -> T, N, Dt, D, S; inputs r: Int32, l: Int32, res: Int32
# ---------- tp: Python ----------
"""Creates a CEM Topology.
    Inputs:
        r: Base radius [m]
        l: Number of layer [int]
        res: Resolution [int]
    Output:
        T: Trail elements
        N: Nodes of the strucutre
        Dt: First Ring of Deviation Elements
        D: Deviation Elements
        S: Support Nodes"""

__author__ = "Frederic Chovghi"

import ghpythonlib.components as gh



###########################################################
## Create CEM Topology
###########################################################

T = []
N = []
Dt = []
D = []
S = []

bp = gh.XYPlane(gh.ConstructPoint(0,0,0)) #Base  plane

for i in range(l):
    
    circle = gh.Circle(bp, r+(i*0.5))
    cp = gh.DivideCurve(circle, res, False)[0]
    N.extend(cp)
    
    pl = gh.PolyLine(cp, True)
    pl = gh.Explode(pl, True)[0]
    
    if i != 0:
        tl = [gh.Line(cp[x], cpp[x]) for x in range(len(cp))]
        T.extend(tl)
    
    cpp = cp[:]
    
    #Export Elements
    if i == 0: Dt.extend(pl)
    if i != 0: D.extend(pl)
    
    if i ==l-1: S.extend(cp)
# ---------- end tp ----------

number_slider = Slider(2, range=-100..100)

# ----
# Color Coding
swatch = ColourSwatch(SwatchColor=RGB(207, 255, 181))
color_coding = GhPythonScript(
    is_planned=ColourSwatch(SwatchColor=RGB(255, 192, 0)),
    is_built=swatch,
    is_support=ColourSwatch(SwatchColor=RGB(0, 0, 255)),
    has_open_connector=ColourSwatch(SwatchColor=RGB(126, 255, 61)),
    has_no_open_connectors=ColourSwatch(SwatchColor=RGB(200, 200, 200)),
    is_built_by_robot=ColourSwatch(SwatchColor=RGB(175, 224, 220)),
    is_built_by_human=ColourSwatch(SwatchColor=RGB(242, 229, 0)))  # -> out, color_coding
# ---------- color_coding: Python ----------
import rhinoscriptsyntax as rs
from compas.colors import Color


color_is_planned = Color(is_planned.R/255 , is_planned.G/255, is_planned.B/255)
color_is_built = Color(is_built.R/255 , is_built.G/255, is_built.B/255)
color_is_support = Color(is_support.R/255 , is_support.G/255, is_support.B/255)
color_has_open_connector = Color(has_open_connector.R/255 , has_open_connector.G/255,has_open_connector.B/255)
color_has_no_open_connectors = Color(has_no_open_connectors.R/255 , has_no_open_connectors.G/255, has_no_open_connectors.B/255)
color_is_built_by_robot = Color(is_built_by_robot.R/255 , is_built_by_robot.G/255, is_built_by_robot.B/255)
color_is_built_by_human = Color(is_built_by_human.R/255 , is_built_by_human.G/255, is_built_by_human.B/255)

color_coding = {'color_is_planned':color_is_planned, 'color_is_built':color_is_built, 'color_is_support':color_is_support, 'color_has_open_connector':color_has_open_connector, 'color_has_no_open_connectors':color_has_no_open_connectors, 'color_is_built_by_robot':color_is_built_by_robot, 'color_is_built_by_human':color_is_built_by_human}

print color_coding
# ---------- end color_coding ----------
panel = Panel(color_coding.out)

panel_2 = Panel("Unload libraries")
bang = Button()
unload = PythonScript(bang=bang)
# ---------- unload: Python ----------
from compas_rhino.utilities.misc import get_tolerance
from compas_rhino.utilities.misc import unload_modules

unload_modules("cdf_2023")
# ---------- end unload ----------

py = PythonScript()  # -> ENVIRONMENT_NAME, HERE, DATA
# ---------- py: Python ----------
import os
import compas_bootstrapper

HERE = os.path.dirname(ghdoc.Path)
DATA = os.path.abspath(os.path.join(HERE, "..", "data"))
ENVIRONMENT_NAME = compas_bootstrapper.ENVIRONMENT_NAME
print(HERE)
print(DATA)
print(ENVIRONMENT_NAME)
# ---------- end py ----------

# ----
# Load Assembly
# Import assembly from .json.
import = Button(ExpressionNormal="True", ExpressionPressed="False")
initial_assembly = GhPythonScript(DATA=py.DATA, import_from_json=import)  # -> out, assembly; inputs import_from_json: Boolean
# ---------- initial_assembly: Python ----------
import os
import json
from scriptcontext import sticky

from cdf_2023.assembly import Assembly

if import_from_json:
    filename = "study_1e.json"
    PATH = os.path.join(DATA, "assembly", filename)
    assembly = Assembly.from_json(PATH)

# create a dictionary to store global value in 
assembly.globals = {}

# define global values
assembly.globals['rod_radius'] = 0.01
assembly.globals['rod_length'] = 0.8
assembly.globals['rf_unit_offset'] = 0.2
assembly.globals['rf_unit_radius'] = 0.15
# ---------- end initial_assembly ----------

brep = Brep(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)

# ----
# Assembly & Element Definition
# Create an element object.
reset_assembly = Button()
globals = GhPythonScript(reset=reset_assembly)  # -> out, assembly
# ---------- globals: Python ----------
from cdf_2023.assembly import Assembly

# create assembly
assembly = Assembly()

# create a dictionary to store global value in 
assembly.globals = {}

# define global values
assembly.globals['rod_radius'] = 0.011
assembly.globals['rod_length'] = 0.8
assembly.globals['rf_unit_offset'] = 0.22
assembly.globals['rf_unit_radius'] = 0.12


print assembly.globals
# ---------- end globals ----------
assembly_globals = Panel(globals.out)
show = BooleanToggle(False)
show_2 = BooleanToggle(False)
elem_def = GhPythonScript(assembly=globals.assembly, show_connectors=show_2, angle=Slider(6, range=4..12), conn_range=brep)  # -> assembly, elem; inputs conn_range: Brep
# ---------- elem_def: Python ----------
import os
import sys
import json
import math

from compas.geometry import Frame, Plane, Rotation, Vector, Point
from compas.geometry import Circle, Cylinder, Translation, Line, Cone
from compas.artists import Artist

from cdf_2023.assembly import Element

rf_unit_offset = assembly.globals['rf_unit_offset']
rf_unit_radius = assembly.globals['rf_unit_radius']
radius = assembly.globals['rod_radius']
length = assembly.globals['rod_length']

cross_section_plane = Plane.from_frame(Frame.worldYZ())
cross_section = Circle(cross_section_plane, radius)
elem_geo = Cylinder(cross_section, length)

elem = Element.from_shape(elem_geo, Frame.worldXY())

connector_frame_1 = Frame([rf_unit_offset,-rf_unit_radius/2,0], [1,0,0], [0,1,0])
connector_frame_2 = Frame([-rf_unit_offset,rf_unit_radius/2,0], [-1,0,0], [0,-1,0])

R1 = Rotation.from_axis_and_angle(connector_frame_1.yaxis, math.radians(angle), connector_frame_1.point)
R2 = Rotation.from_axis_and_angle(connector_frame_2.yaxis, math.radians(angle), connector_frame_2.point)

connector_frame_1.transform(R1)
connector_frame_2.transform(R2)

elem.connector_frame_1 = connector_frame_1
elem.connector_frame_2 = connector_frame_2

elem.line = Line([-length/2.,0,0],[length/2.,0,0])


circle_frame_1 = Frame([-0.34,0,0],[0,0,-1],[0,1,0])
circle_frame_2 = Frame([0.34,0,0],[0,0,1],[0,1,0])
circle_1 = Circle(Plane.from_frame(circle_frame_1), 0.5)
circle_2 = Circle(Plane.from_frame(circle_frame_2), 0.5)
cone_2 = Cone(circle_1, 0.32)
cone_1 = Cone(circle_2, 0.32)

elem.connector_range_1 = cone_1
elem.connector_range_2 = cone_2

#print elem.connector_range_1
# ---------- end elem_def ----------
draw = PythonScript(elements=elem_def.elem, show=show)  # -> M, F, C; inputs elements: list
# ---------- draw: Python ----------
from compas.artists import Artist

M = []
C = []
F = []
T = []

if show:
    for elem in elements:
        C.append(Artist(elem.connector_frame_1).draw())
        C.append(Artist(elem.connector_frame_2).draw())
        M += [Artist(elem._mesh).draw([0,0,1,1])]
        F += [Artist(elem.frame).draw()]
        T += [Artist(elem.tool_frame).draw()]
# ---------- end draw ----------
mesh = Mesh(draw.M)
pln = Plane(draw.F)
pln_2 = Plane(draw.C)
custom_preview = CustomPreview(Geometry=mesh, Material=ColourSwatch(SwatchColor=RGB(221, 0, 0)))

panel_3 = Panel(py.ENVIRONMENT_NAME)

# ----
# Generate Assembly
# Initial Assembly Configuration
pt = Point(<point referenced from the Rhino model>)
x = Curve(<curve referenced from the Rhino model>)
y = Curve(<curve referenced from the Rhino model>)
pl = ConstructPlane(Origin=pt, XAxis=x, YAxis=y)
worldxy = Plane(PlaneXY(0, 0, 0))
initial_configuration = GhPythonScript(assembly=elem_def.assembly, planes=pl, elem=elem_def.elem, show_open_connectors=Toggle(False))  # -> out, assembly, connector_planes; inputs planes: list of Plane
# ---------- initial_configuration: Python ----------
import Rhino.Geometry as rg
import math
from scriptcontext import sticky as st

from compas.geometry import Frame, Vector
from compas.geometry import Rotation, Transformation
from compas.artists import Artist


connector_planes = []
support_keys = []

radius = assembly.globals['rod_radius']
length = assembly.globals['rod_length']
rf_unit_offset = assembly.globals['rf_unit_offset']
rf_unit_radius = assembly.globals['rf_unit_radius']


for plane in planes:
    T1 = Transformation.from_frame_to_frame(Frame.worldXY(), Frame(plane.Origin, plane.XAxis, plane.YAxis))
    elem_1 = elem.transformed(T1)
    
    R1 = Rotation.from_axis_and_angle(elem_1.frame.zaxis, math.radians(120), [0,0,0])
    R2 = Rotation.from_axis_and_angle(elem_1.frame.zaxis, math.radians(240), [0,0,0])
    
    # set connector state
    elem_1.connector_1_state = True
    elem_1.connector_2_state = False

    # add element to assembly
    assembly.add_element(elem_1, placed_by='initial', is_support=True, frame_id=None)

# show open connectors
if show_open_connectors:
    for key, connectors in assembly.connectors(state='open'):
        for connector in connectors:
            connector_planes.append(Artist(connector).draw())

for key, element in assembly.elements():
    support_keys.append(key)
    
assembly.support_keys = support_keys
# ---------- end initial_configuration ----------
pln_3 = Plane(initial_configuration.connector_planes)

list = ValueList({"1. GLOBAL stability": 0, "2. LOCAL stability": 1, "3. NO stability criteria": 2}, selected="2. LOCAL stability")
brep_2 = Brep(<brep referenced from the Rhino model>)

# ---- group: inverse kinematics
select_configuration = Slider(2, range=0..7)
plane = Plane(Plane(origin=(-2.203675245, 7.733279398, 1.329211851), x=(1, 0, 0), y=(0, -1, 0)))

# ----
# Transform Assembly
pt_2 = Point(<point referenced from the Rhino model>)
x_2 = Curve(<curve referenced from the Rhino model>)
y_2 = Curve(<curve referenced from the Rhino model>)
pl_2 = ConstructPlane(Origin=pt_2, XAxis=x_2, YAxis=y_2)
transform = GhPythonScript(assembly=initial_configuration.assembly, transform=Toggle(False), trnsf_plane=pl_2)  # -> out, assembly
# ---------- transform: Python ----------
from compas.geometry import Frame
from compas.geometry import Transformation
import Rhino.Geometry as rg
from compas.artists import Artist


if transform:
    T = Transformation.from_frame_to_frame(assembly.element(0).frame, Frame(trnsf_plane.Origin, trnsf_plane.XAxis, trnsf_plane.YAxis))
    assembly.transform(T)
    assembly.network.transform(T)
# ---------- end transform ----------

# ---- group: capture
viewport_name = Text("workflow_2")
capture_to_bitmap = PythonScript(DATA=py.DATA, capture=Button(), viewport_name=viewport_name, idx=Slider(2, range=0..10))  # -> out, a; inputs capture: Boolean, idx: Int32
# ---------- capture_to_bitmap: Python ----------
import Rhino
import System.Drawing
from scriptcontext import sticky as st

import sys, os
import ghpythonlib.components as ghcomp
import Grasshopper as gh
import datetime


ghComp = ghenv.Component
ghDoc = ghComp.OnPingDocument()

def rCommonCap(filePath, viewportName,scaleFactor):
    RhinoDocument = Rhino.RhinoDoc.ActiveDoc
    view = RhinoDocument.Views.Find(viewportName, False)
    vp = view.ActiveViewport
    size = System.Drawing.Size(vp.Size.Width*scaleFactor,vp.Size.Height*scaleFactor)
    capture = view.CaptureToBitmap(size)
    capture.Save(filePath);


export_dir = os.path.join(DATA, 'parameter_studies')
if not os.path.isdir(export_dir): os.mkdir(export_dir)
print export_dir
filename = os.path.join(export_dir, 'capture_' + str(idx) + '.png') 
print filename

zoom = 1

if capture:
    rCommonCap(filename, viewport_name, zoom)
# ---------- end capture_to_bitmap ----------

# ----
# 01 - CEM Model
series = Series(Start=0, Step=expr("1/(x-2)", l_int), Count=expr("x-1", l_int))
construct_domain = ConstructDomain(DomainStart=number_slider, DomainEnd=Slider(-5, range=-100..100))
graph_mapper = GraphMapper(
    series,
    x0=0,
    x1=1,
    y0=0,
    y1=1,
    container_name="Bezier",
    cpx=[0, 0.1110594943, 0.8710654378, 1],
    cpy=[0, 0, 0.5437971354, 1])
remap_numbers = RemapNumbers(Value=graph_mapper, Source=Domain(0, 1), Target=construct_domain)  # -> graft(Mapped), Clipped
repeat_data = RepeatData(Data=remap_numbers.Mapped, Length=res_int)  # -> flatten(Data)
cem_deviation = CEM_Deviation(DeviationEdge=tp.Dt, DeviationMagn=number_slider)
cem_deviation_2 = CEM_Deviation(DeviationEdge=tp.D, DeviationMagn=repeat_data)
cem_load = CEM_Load(PointLoad=tp.N, LoadMagnZ=Slider(-1, range=-100..100))
cem_trail = CEM_Trail(TrailEdge=tp.T, TrailLen=Slider(-0.5, range=-100..100))
cem_support = CEM_Support(Support=tp.S)
cem_build_topology = CEM_Build_Topology(T=flatten(cem_trail), L=cem_load, D=flatten([cem_deviation, cem_deviation_2]), S=flatten(cem_support))
cem_extract_topology = CEM_Extract_Topology(TP=cem_build_topology)  # -> Nodes, NodesID, Edges, EdgesID, ConstraintPlane, ConstraintPlaneID, OriginNode, OriginNodeID
cem_origin_node = CEM_Origin_Node(OriginNode=cem_extract_topology.OriginNode, OriginNodeID=cem_extract_topology.OriginNodeID)
cem_calculate_structure = CEM_Calculate_Structure(TP=cem_build_topology, N=cem_origin_node)
cem_extract_structure = CEM_Extract_Structure(M=cem_calculate_structure)  # -> Nodes, NodesID, Trails, TrailsID, TrailsCol, TrailsMag, Deviations, DeviationsID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
end_points = EndPoints(Curve=cem_extract_structure.ExternalForces)  # -> Start, End
scale = Scale(Geometry=cem_extract_structure.ExternalForces, Center=end_points.Start, Factor=0.25)  # -> Geometry, Transform

# ----
# 02 - Mesh model
join_curves = JoinCurves(Curves=cem_extract_structure.Deviations, Preserve=False)
construct_point = ConstructPoint(XCoordinate=100, YCoordinate=0, ZCoordinate=0)
curve_closest_point = CurveClosestPoint(Point=construct_point, Curve=join_curves)  # -> Point, Parameter, Distance
deconstruct = Deconstruct(Point=curve_closest_point.Point)  # -> XComponent, YComponent, ZComponent
seam = Seam(Curve=flatten(join_curves), Seam=flatten(curve_closest_point.Parameter))
sort_list = SortList(Keys=deconstruct.ZComponent, ValuesValuesA=seam)  # -> Keys, ValuesValuesA
mesh_2 = GhPythonScript(C=sort_list.ValuesValuesA)  # -> M; inputs C: list of Curve
# ---------- mesh_2: Python ----------
import ghpythonlib.components as gh

M = []

for i in range(len(C)-1):
    
    cp_a = gh.ControlPoints(C[i])[0]
    cp_b = gh.ControlPoints(C[i+1])[0]
    
    for k in range(len(cp_a)-1):
        
        mloc = gh.ConstructMesh([cp_a[k], cp_a[k+1], cp_b[k+1], cp_b[k]], 'Q{0;1;2;3}')
        M.append(mloc)

M = gh.MeshJoin(M)
# ---------- end mesh_2 ----------
deconstruct_box = DeconstructBox(Box=mesh_2)  # -> Plane, X, Y, Z
unit_z = UnitZ(Factor=deconstruct_box.Z)
move = Move(Geometry=mesh_2, Motion=unit_z)  # -> Geometry, Transform
custom_preview_2 = CustomPreview(Geometry=move.Geometry, Material=ColourSwatch(SwatchColor=RGBA(76, 76, 76, 44)))

move_2 = Move(Geometry=flatten([cem_extract_structure.Trails, cem_extract_structure.Deviations]), Motion=unit_z)  # -> Geometry, Transform
move_3 = Move(Geometry=flatten(scale.Geometry), Motion=unit_z)  # -> Geometry, Transform
custom_preview_3 = CustomPreview(Geometry=move_2.Geometry, Material=[cem_extract_structure.TrailsCol, cem_extract_structure.DeviationsCol])
custom_preview_4 = CustomPreview(Geometry=move_3.Geometry, Material=cem_extract_structure.ExternalForcesCol)

angle_weight = Slider(1, range=0.1..1.1)
dist_weight = Slider(1, range=0..1)
mesh_3 = Mesh(move.Geometry)

py_2 = PythonScript()  # -> repositories_path, rbvogui_data_path, ur_data_path
# ---------- py_2: Python ----------
import os

"""
ASSUMING THE BELOW PACKAGES ARE STORED IN THE SAME LOCATION:
    ur_fabrication_control;
    rbvogui_common; and
    mobile_additive_manufacturing.
"""

repositories_path = os.path.abspath(os.path.join(ghdoc.Path,"../../../"))

assert os.path.exists(os.path.join(repositories_path, "ur_fabrication_control/data"))
assert os.path.exists(os.path.join(repositories_path, "rbvogui_common/rbvogui_description"))
assert os.path.exists(os.path.join(repositories_path, "mobile_robot_control"))

ur_data_path = os.path.abspath(os.path.join(ghdoc.Path,"../../../ur_fabrication_control/data"))
rbvogui_data_path = os.path.abspath(os.path.join(repositories_path, "rbvogui_common"))
# ---------- end py_2 ----------
list_2 = ValueList({"indoor", "outdoor"}, selected="indoor")
base_plane = Plane(Plane(origin=(-0.8631008395, 0.09247245376, 2.914916263e-11), x=(0.9028524237, 0.4299505798, 0), y=(-0.4299505798, 0.9028524237, -9.269687876e-11)))
list_3 = ValueList({"default", "measured", "initial"}, selected="default")
l = Slider(0, range=0..0.72)

# ----
# Load robot from local package
python = GhPythonScript(choice=list_3, vertical_axis_height=Slider(0.021, range=0..0.72), vertical_axis_correction=Slider(0, range=-0.1..0.1))  # -> out, ur_base_frame_rhino_local_tf, ur_base_plane
# ---------- python: Python ----------
import rhinoscriptsyntax as rs
from compas.geometry import Frame
from compas.geometry import Translation
from compas_ghpython.utilities import draw_frame

if choice=="measured":
    ur_base_frame_rhino_local_tf = Frame(ur_base_plane_rhino_local_tf.Origin, 
                                         ur_base_plane_rhino_local_tf.XAxis, 
                                         ur_base_plane_rhino_local_tf.YAxis)
    T = Translation.from_vector(ur_base_frame_rhino_local_tf.zaxis*(vertical_axis_height+vertical_axis_correction))
    ur_base_frame_rhino_local_tf = ur_base_frame_rhino_local_tf.transformed(T)
elif choice=="initial":
    ur_base_frame_rhino_local_tf = Frame(ur_base_plane_init.Origin, 
                                         ur_base_plane_init.XAxis, 
                                         ur_base_plane_init.YAxis)
    T = Translation.from_vector(ur_base_frame_rhino_local_tf.zaxis*(vertical_axis_height+vertical_axis_correction))
    ur_base_frame_rhino_local_tf = ur_base_frame_rhino_local_tf.transformed(T)

elif choice =="default":
    ur_base_frame_rhino_local_tf = Frame([0.275, 0.0, 1.105], [-0.707, 0.707, 0.0], [-0.707, -0.707,0.0])
    T = Translation.from_vector(ur_base_frame_rhino_local_tf.zaxis*(vertical_axis_height+vertical_axis_correction))
    ur_base_frame_rhino_local_tf = ur_base_frame_rhino_local_tf.transformed(T)


ur_base_plane = draw_frame(ur_base_frame_rhino_local_tf)
# ---------- end python ----------

# ----
# Robot Model
py_3 = PythonScript(
    repositories_path=py_2.repositories_path,
    rbvogui_data_path=py_2.rbvogui_data_path,
    ur_data_path=py_2.ur_data_path,
    wheel_type=list_2)  # -> loaders, urdf_filename, srdf_filename
# ---------- py_3: Python ----------
import os
from compas.robots import LocalPackageMeshLoader

#loaders

ur_path = os.path.join(ur_data_path, "robot_description")
ur_packages = ["ur_description", "ur_e_description", "ur_end_effectors", "ur_setups"]
ur_loaders = [LocalPackageMeshLoader(ur_path, pck) for pck in ur_packages]

rbvogui_packages = ["rbvogui_description"]
rbvogui_loaders = [LocalPackageMeshLoader(rbvogui_data_path, pck) for pck in rbvogui_packages]

ewellix_packages = ["ewellix_description"]
ewellix_loaders = [LocalPackageMeshLoader(repositories_path, pck) for pck in ewellix_packages]

sensors_packages = ["robotnik_sensors"]
sensors_loaders = [LocalPackageMeshLoader(repositories_path, pck) for pck in sensors_packages]

loaders = ur_loaders + rbvogui_loaders + ewellix_loaders + sensors_loaders

#files
if wheel_type=="indoor":
    urdf_filename = os.path.join(repositories_path, r"mobile_robot_control\data\rbvogui_xl_lift_ur10e_indoor.urdf")
if wheel_type == "outdoor":
    urdf_filename = os.path.join(repositories_path, r"mobile_robot_control\data\rbvogui_xl_lift_ur10e.urdf")
srdf_filename = os.path.join(repositories_path, r"mobile_robot_control\data\rbvogui.srdf")

assert os.path.isfile(urdf_filename)
assert os.path.isfile(srdf_filename)
# ---------- end py_3 ----------
units = ValueList({"m": 1, "cm": 100, "mm": 1000}, selected="m")
load = Button()
create = PythonScript(
    load=load,
    ur_base_frame_rhino_local_tf=python.ur_base_frame_rhino_local_tf,
    loaders=py_3.loaders,
    urdf_filename=py_3.urdf_filename,
    srdf_filename=py_3.srdf_filename,
    scale_factor=units)  # -> out, robot, rcf; inputs load: Boolean, loaders: list
# ---------- create: Python ----------
import os
from scriptcontext import sticky as st

import compas

from compas_ghpython import draw_frame
from compas.robots import RobotModel
from compas.robots import LocalPackageMeshLoader

from mobile_robot_control.mobile_robot import MobileRobot
from compas_fab.robots import RobotSemantics
from compas_fab.ghpython import RobotArtist

compas.PRECISION = '12f'

# store robot in component
guid = str(ghenv.Component.InstanceGuid)
robot_key = "robot"

if robot_key not in st:
    st[robot_key] = None

#print loaders
if load:
    model = RobotModel.from_urdf_file(urdf_filename)
    
    model.load_geometry(*loaders)
    artist = RobotArtist(model)
    semantics = RobotSemantics.from_srdf_file(srdf_filename, model)
    robot = MobileRobot(model, artist, semantics, client=None)
    
    st[robot_key] = robot

robot = st[robot_key]
print(robot)
#rcf = draw_frame(robot.get_RCF())
#print(rcf)

if robot:
    robot.scale(scale_factor)
    #robot.RCF_in_WCF = ur_base_frame_rhino_local_tf
# ---------- end create ----------
robot = Data(create.robot)

# ----
# Tool
list_4 = ValueList({"measurement_tool": 0, "parallel_gripper": 1}, selected="parallel_gripper")
show_3 = BooleanToggle(True)
py_4 = PythonScript()  # -> DATA
# ---------- py_4: Python ----------
import os

#package_path = os.path.dirname(mobile_fabrication_control.__file__)


package_path = ghdoc.Path
DATA = os.path.abspath(os.path.join(package_path,"../../data"))

# package_path = os.path.dirname(ur_fabrication_control.__file__)
#DATA = os.path.abspath(os.path.join(package_path,"../../data"))

# .stl files not stored in am_hackathon repo. but in mobile_fabrication_control
#DATA = os.path.abspath(os.path.join(package_path,"../../../workshop_aaec_revamp/data"))

print(package_path)
print(DATA)
# ---------- end py_4 ----------
tool = PythonScript(data_path=py_4, tool=list_4, show=show_3)  # -> tool, M, ee_plane
# ---------- tool: Python ----------
import os, math
from compas.geometry import Frame, Rotation
from compas.datastructures import Mesh
from compas_ghpython.artists import MeshArtist
from compas_fab.robots import Tool
from compas_ghpython.utilities import draw_frame

tolerance = 0

if tool == 0:
    filename = 'measurement_tool_zaxis.stl'
    ee_frame = Frame([0, 0, 0.109], [1, 0, 0], [0, 1, 0])

elif tool == 1:
    #filename = 'parallel_gripper_muc.stl'
    filename = 'parallel_gripper_without_rod.stl'
    ee_frame = Frame([0, 0, 0.145], [1, 0, 0], [0, 1, 0])


data_path = os.path.join(data_path, "tool_geometry")
fullfilename = os.path.join(data_path, filename)
print fullfilename

ee_mesh = Mesh.from_stl(fullfilename)

if show:
    artist = MeshArtist(ee_mesh)
    M = artist.draw()

tool = Tool(ee_mesh, ee_frame)
ee_plane = draw_frame(ee_frame)
print(ee_frame.quaternion.xyzw)
ee_framek = Frame([0.0110607,0.00809854,0.41498], [0,1,0], [1,0,0])
print(ee_framek.quaternion.xyzw)
# ---------- end tool ----------
panel_4 = Panel("Attach a custom tool")
remove = Button()
add = Button()
attach_remove = PythonScript(robot=robot, tool=tool.tool, attach=add, remove=remove)  # -> out, bang
# ---------- attach_remove: Python ----------
if attach:
    robot.attach_tool(tool)
if remove:
    robot.detach_tool()
# ---------- end attach_remove ----------

# ----
# Base
set_base_frame = PythonScript(robot=robot, base_plane=base_plane)  # -> bang
# ---------- set_base_frame: Python ----------
from compas_ghpython import draw_frame
from compas.geometry import Frame, Point, Vector, Transformation
from compas.datastructures import Mesh
from compas_rhino.geometry import RhinoMesh
from compas_fab.robots import CollisionMesh

if base_plane:
    base_frame = Frame(base_plane.Origin, base_plane.XAxis, base_plane.YAxis)
else:
    base_frame = Frame.worldXY()

if robot:
    # base_frame is BCF in WCF
    robot.BCF = base_frame
    
    print(robot.BCF)
# ---------- end set_base_frame ----------

# ----
# Info
info = PythonScript(robot=robot)  # -> out, main_group_name
# ---------- info: Python ----------
if robot:
    robot.info()
    main_group_name = robot.main_group_name
# ---------- end info ----------
panel_5 = Panel(info.out)

# ---- group: forward kinematics
a6 = Slider(0, range=-360..360)
a1 = Slider(30, range=-360..360)
a2 = Slider(-90, range=-360..360)
a3 = Slider(90, range=-360..360)
a4 = Slider(0, range=-360..360)
a5 = Slider(90, range=-360..360)
jp = GhPythonScript()  # -> joint_positions
# ---------- jp: Python ----------
import math

joint_positions = [0, 0,-90,90,0,90,0]
joint_positions = [math.radians(a) for a in joint_positions]
#joint_positions = [-3.136, -0.328, -1.218, 3.129, 0.852, 0.008]
#joint_positions = [0] * 6



print joint_positions
# ---------- end jp ----------
forward_kinematics = PythonScript(robot=robot, set_joint_positions=Button(), joint_positions=jp, lift=l, a1=a1, a2=a2, a3=a3, a4=a4, a5=a5, a6=a6)  # -> full_configuration; inputs joint_positions: list
# ---------- forward_kinematics: Python ----------
import math
import Grasshopper
from compas.robots import Joint
from compas_fab.robots import Configuration

if set_joint_positions:
    j = 0
    for i in range(ghenv.Component.Params.Input.Count):
        nslider = ghenv.Component.Params.Input[i].Sources[0]
        if nslider.GetType() == Grasshopper.Kernel.Special.GH_NumberSlider:
            nslider.TrySetSliderValue(math.degrees(joint_positions[j]))
            j += 1

if robot:
    joint_positions = [lift, a1, a2, a3, a4, a5, a6]
    joint_types = robot.get_configurable_joint_types()
    joint_names = robot.get_configurable_joint_names()
#    joint_types = [type for type in joint_types if type == Joint.REVOLUTE]
    
    for i, joint_type in enumerate(joint_types):
        if joint_type == Joint.REVOLUTE:
            joint_positions[i] = math.radians(joint_positions[i])
        else:
            joint_positions[i] = joint_positions[i]
    
    full_configuration = Configuration(joint_positions, joint_types, joint_names)
    
print(full_configuration)
# ---------- end forward_kinematics ----------

# ----
# Settings
reset_key = Button()
shift_value = Slider(0, range=-0.15..0.05)
angle = Slider(0, range=0..360)
collision = BooleanToggle(True)
next = Button()
prev = Button()
flip = BooleanToggle(False)

pln_4 = Plane(create.rcf)

# ----
# Assembly Branches
number_slider_2 = Slider(0, range=0..10)  # disabled

# ----
# Assembly Visualization
# 1. Visualize assembly.
# 2. Visualize selected option.
# 3. Visuilize current options (all/filtered).
list_5 = ValueList({"'Built by Human/Robot'": 0, "'Design Generation'": 1, "'Assembly Workflow'": 2}, selected="'Design Generation'")
show_4 = BooleanToggle(True)
show_5 = BooleanToggle(False)
show_6 = BooleanToggle(False)
show_7 = BooleanToggle(True)
show_8 = BooleanToggle(False)
show_9 = BooleanToggle(False)
show_10 = BooleanToggle(False)

# ----
# Aggregate
options_num = Slider(80, range=1..100)
iterations = Slider(1, range=1..10)
human_adds = Button()
robot_adds = Button()
aggregate = Button()
add_two = Button()
update = GhPythonScript(trigger=[robot_adds, human_adds, add_two, aggregate])  # -> update; inputs trigger: list
# ---------- update: Python ----------
update = False

for value in trigger:
    if value:
        update = True

print update
# ---------- end update ----------

inputs = GhPythonScript(
    assembly=elem_def.assembly,
    next_element=next,
    prev_element=prev,
    angle=angle,
    shift_value=shift_value,
    target_geo=mesh_3,
    dist_weight=dist_weight,
    angle_weight=angle_weight,
    collision_check=collision,
    support=brep_2,
    stability=list,
    reset_key=reset_key,
    update=update)  # -> out, assembly, selected_key, angle, shift_value, selected_connector_plane; inputs target_geo: Mesh, support: Brep
# ---------- inputs: Python ----------
import math
import random
from scriptcontext import sticky as st
import Rhino.Geometry as rg

import ghpythonlib.components as ghcomp

from compas.geometry import Frame, Box, Point
from compas.geometry import Vector, Translation, angle_vectors, Rotation
from compas.artists import Artist

all_options = []
filtered_keys = []
distances = []
vectors = []
origins = []

stability_criteria = {0:'global', 1:'local', 2:'no_stability_check'}
assembly.stability_criteria = stability_criteria[stability]
assembly.support = support
assembly.target_geo = target_geo

#############################################################################
## OPTIONS
#############################################################################

for key, element in assembly.elements():
    for origin, vector in element.current_option_vectors(0.40):
        all_options.append((key, origin, vector))

assembly.current_options = all_options

# all options keys
open_connectors_keys = [option[0] for option in assembly.current_options]

open_connectors_keys = list(set(open_connectors_keys))
assembly.open_connectors_keys = open_connectors_keys

#############################################################################
## SELECT A KEY
#############################################################################

guid = str(ghenv.Component.InstanceGuid)
element_key = "elem_" + guid

if element_key not in st or None:
    st[element_key] = 0

if reset_key:
    st[element_key] = 0

if next_element:
    if st[element_key] < len(open_connectors_keys) - 1:
        st[element_key] += 1

if prev_element:
    if st[element_key] <= len(open_connectors_keys) - 1:
        st[element_key] -= 1

    if st[element_key] < 1:
        st[element_key] = 0


#############################################################################
## OPEN CONNECTORS
#############################################################################

if len(open_connectors_keys) == 0: 
    selected_key = 0
    print("!!! NO OPEN CONNECTORS AVAILABLE !!!")
    print("Suggestion: RESET KEY!")
else:
    selected_key = open_connectors_keys[st[element_key]]
    print("Element with key {} selected.".format(selected_key))
    
selected_elem = assembly.network.node[selected_key]['element']

#############################################################################
## DISPLAY SELECTED CONNECTOR
#############################################################################

if selected_key:
    selected_connenctor_frame = assembly.element(selected_key).connectors(state='open')[0]

    R = Rotation.from_axis_and_angle(selected_elem.frame.xaxis, math.radians(angle), selected_elem.frame.point)
    
    selected_connenctor_frame_copy = selected_connenctor_frame.transformed(R)
    selected_connector_plane = Artist(selected_connenctor_frame_copy).draw()

#############################################################################
## DISTANCE TO INPUT GEO
#############################################################################

    distance, shortest_vector = assembly.distance_to_target_geo(selected_key, angle, target_geo)
    
    # Vector Display
    vectors.append(shortest_vector)
    origins.append(selected_connector_plane.Origin)
    
    print 'Key {}: {dist:.2f}m is the distance to the input geometry.'. format(selected_key, dist=distance)

#############################################################################
## ORIENTATION TO INPUT GEO
#############################################################################

    output_value, shortest_vector = assembly.orientation_to_target_geo(selected_key, angle, target_geo)
    
    # Vector Dispaly
    vectors.append(selected_connector_plane.ZAxis)
    origins.append(selected_connector_plane.Origin)
    
    print 'Key {}: {len:.2f} is the length of the cross product vector.'. format(selected_key, len=output_value)

#############################################################################
## LAST ADDED KEYS
#############################################################################

key_index = assembly.network.key_index()
keys = [key_index[key] for key in assembly.network.nodes()]
new_keys = keys[-2:]
assembly.last_added = new_keys
print 'Last added keys:', ', '.join(map(str, new_keys))
# ---------- end inputs ----------
keys_status_update = Panel(inputs.out)
pln_5 = Plane(inputs.selected_connector_plane)
shift_value_2 = Panel(inputs.shift_value)
selected_key = Panel(inputs.selected_key)
angle_2 = Panel(inputs.angle)

aggregate_2 = GhPythonScript(
    assembly=transform.assembly,
    elem=elem_def.elem,
    selected_key=inputs.selected_key,
    angle=inputs.angle,
    shift_value=inputs.shift_value,
    dist_weight=dist_weight,
    angle_weight=angle_weight,
    flip_human_robot=flip,
    collision_check=collision,
    robot_adds=robot_adds,
    human_adds=human_adds,
    add_two=add_two,
    options_num=options_num,
    iterations=iterations,
    aggregate=aggregate)  # -> out, assembly; inputs iterations: Int32
# ---------- aggregate_2: Python ----------
import sys
import random
from scriptcontext import sticky as st
import ghpythonlib.components as ghcomp
import math

from compas.geometry import distance_line_line, Line, is_intersection_line_line, Plane, Frame, is_intersection_line_plane
from compas.artists import Artist
import Rhino.Geometry as rg
import rhinoscriptsyntax as rs

import ghpythonlib.components as gh

flip = 'AA'
#selected_key = st["selected_key"]

#############################################################################
## ADD ELEMENTS TO ASSEMBLY
#############################################################################

# Robot adds first element
if robot_adds:
    assembly.add_rf_unit_element(selected_key, flip, angle, shift_value, placed_by ='robot', on_ground=False, unit_index=0)
    
# Human adds second element element
if human_adds:
    assembly.add_rf_unit_element(selected_key, flip, angle, shift_value, placed_by ='human', on_ground=False, unit_index=1)

# Add two elements
if add_two:
    assembly.close_rf_unit(selected_key, flip, angle, shift_value, on_ground = False)



#############################################################################
## GROWTH ALONG AN INPUT GEOMETRY WITH GLOBAL STABILITY
#############################################################################

if aggregate and assembly.stability_criteria == 'global':
    msgs = []
    for i in range (iterations): 
        print('---------------------- Start ----------------------')
        keys = [key for key, frames in assembly.connectors('open') if frames!=[]]
        options_count = 0
        fitness_table = []
        
        while options_count < options_num: 
            random_key = random.choice(keys)
            random_angle = random.uniform(0., 360.)
            random_shift = random.uniform(-0.04, 0.04)
            random_option_elems = assembly.element(random_key).current_option_elements(flip, random_angle, random_shift)
            
            is_colliding = assembly.collision_check(random_option_elems, tolerance = -0.001) if collision_check else False
            
            global_equilibrium, resultant = assembly.calculate_global_equilibrium(assembly.support, random_option_elems, radius=0.01)
            
            random_elems_frames = [element.frame for element in random_option_elems]
            is_away_from_ground = all(frame.point.z > 0.2 for frame in random_elems_frames)
            
            if not is_colliding and global_equilibrium and is_away_from_ground:
                
                output_value, vector = assembly.orientation_to_target_geo(selected_key, random_angle, assembly.target_geo)
                distance, vector = assembly.distance_to_target_geo(selected_key, random_angle, assembly.target_geo)
                
                dist = rs.Distance(rs.CurveEndPoint(resultant), rs.SurfaceAreaCentroid(assembly.support)[0])

                if distance > 10.0:
                    print "Interrupted"
                    break
                else:
                    score = output_value*angle_weight + distance*dist_weight + 1/dist
                
                fitness_table.append([random_key, random_angle, random_shift, score])
                
                options_count += 1
                
        fitness_table_sorted = sorted(fitness_table,key=lambda x:x[3], reverse=True)
        
        msgs.append('{}.ITERATION:'.format(i))
        msgs.append('ELEMENT KEY {} with the highest score: {}'.format(fitness_table_sorted[0][0], fitness_table_sorted[0][3]))
        assembly.close_rf_unit(fitness_table_sorted[0][0], flip, fitness_table_sorted[0][1], fitness_table_sorted[0][2], on_ground = False)
        msgs.append('------- New elements added to assembly -------')
        for msg in msgs:
            print(msg)


#############################################################################
## GROWTH ALONG AN INPUT GEOMETRY WITH LOCAL STABILITY
#############################################################################

if aggregate and assembly.stability_criteria == 'local':
    msgs = []
    for i in range (iterations): 
        print('---------------------- Start ----------------------')
        keys = [key for key, frames in assembly.connectors('open') if frames!=[]]
        options_count = 0
        fitness_table = []
        
        while options_count < options_num: 
            random_key = random.choice(keys)
            random_angle = random.uniform(0., 360.)
            random_shift = random.uniform(-0.04, 0.04)
            random_option_elems = assembly.element(random_key).current_option_elements(flip, random_angle, random_shift)
            
            is_colliding = assembly.collision_check(random_option_elems, tolerance = -0.001) if collision_check else False
            
            cp = [Artist(assembly.element(key).line.midpoint).draw() for key, element in assembly.elements()]
            cp += [Artist(random_option_elem.line.midpoint).draw() for random_option_elem in random_option_elems]
            sp = [Artist(assembly.element(0).line.end).draw()]
            
            lever_arm, resultant_point = assembly.calculate_local_equilibrium(cp, sp, assembly.globals['rod_length'], assembly.globals['rod_radius'])
            
            random_elems_frames = [element.frame for element in random_option_elems]
            is_away_from_ground = all(frame.point.z > 0.2 for frame in random_elems_frames)
            
            if not is_colliding and is_away_from_ground:
                
                output_value, vector = assembly.orientation_to_target_geo(selected_key, random_angle, assembly.target_geo)
                distance, vector = assembly.distance_to_target_geo(selected_key, random_angle, assembly.target_geo)

                if distance > 10.0:
                    print "Interrupted"
                    break
                else:
                    score = output_value*angle_weight + distance*dist_weight + 1/lever_arm[0]
                
                fitness_table.append([random_key, random_angle, random_shift, score])
                
                options_count += 1
                
        fitness_table_sorted = sorted(fitness_table,key=lambda x:x[3], reverse=True)
        
        msgs.append('{}.ITERATION:'.format(i))
        msgs.append('ELEMENT KEY {} with the highest score: {}'.format(fitness_table_sorted[0][0], fitness_table_sorted[0][3]))
        assembly.close_rf_unit(fitness_table_sorted[0][0], flip, fitness_table_sorted[0][1], fitness_table_sorted[0][2], on_ground = False)
        msgs.append('------- New elements added to assembly -------')
        for msg in msgs:
            print(msg)

#############################################################################
## RANDOM GROWTH
#############################################################################

if aggregate and assembly.stability_criteria == 'no_stability_check':
    msgs = []
    for i in range (iterations): 
        print('---------------------- Start ----------------------')
        keys = [key for key, frames in assembly.connectors('open') if frames!=[]]
        options_count = 0
        fitness_table = []
        
        while options_count < options_num: 
            random_key = random.choice(keys)
            random_angle = random.uniform(0., 360.)
            random_shift = random.uniform(-0.04, 0.04)
            random_option_elems = assembly.element(random_key).current_option_elements(flip, random_angle, random_shift)
            
            is_colliding = assembly.collision_check(random_option_elems, tolerance = -0.001) if collision_check else False
            
            random_elems_frames = [element.frame for element in random_option_elems]
            is_away_from_ground = all(frame.point.z > 0.2 for frame in random_elems_frames)
            
            if not is_colliding and is_away_from_ground:
                
                output_value, vector = assembly.orientation_to_target_geo(selected_key, random_angle, assembly.target_geo)
                distance, vector = assembly.distance_to_target_geo(selected_key, random_angle, assembly.target_geo)
                
                if distance > 10.0:
                    print "Interrupted"
                    break
                else:
                    score = output_value*angle_weight + distance*dist_weight
                
                fitness_table.append([random_key, random_angle, random_shift, score])
                
                options_count += 1
                
        fitness_table_sorted = sorted(fitness_table,key=lambda x:x[3], reverse=True)
        
        msgs.append('{}.ITERATION:'.format(i))
        msgs.append('ELEMENT KEY {} with the highest score: {}'.format(fitness_table_sorted[0][0], fitness_table_sorted[0][3]))
        assembly.close_rf_unit(fitness_table_sorted[0][0], flip, fitness_table_sorted[0][1], fitness_table_sorted[0][2], on_ground = False)
        msgs.append('------- New elements added to assembly -------')
        for msg in msgs:
            print(msg)
# ---------- end aggregate_2 ----------
rec = DataRecorder(aggregate_2.out, DataLimit=-10, RecordData=True)
panel_6 = Panel(rec)

branches = GhPythonScript(assembly=aggregate_2.assembly, branch_idx=number_slider_2)  # -> out, G_branch_elems, G_branch_midpoints; inputs branch_idx: Int32; disabled
# ---------- branches: Python ----------
import rhinoscriptsyntax as rs
from compas.geometry import Line
from compas.topology import connected_components
from compas.artists import Artist


branches = connected_components(assembly.network.adjacency)
print 'The assembly structure has {} branches.'.format(len(branches))
G_branch_elems = [Artist(assembly.element(key).mesh).draw() for key in branches[branch_idx]]
G_branch_midpoints = [Artist(assembly.element(key).line.midpoint).draw() for key in branches[branch_idx]]
# ---------- end branches ----------
mesh_4 = Mesh(branches.G_branch_elems)  # disabled
pt_3 = Point(branches.G_branch_midpoints)  # disabled
assembly_branches = Panel(branches.out)  # disabled

assembly_viz = PythonScript(
    assembly=aggregate_2.assembly,
    preview_mode=list_5,
    show_assembly=show_4,
    show_support=show_5,
    show_option=show_6,
    show_last=show_7,
    show_arrows=show_8,
    show_open_connectors=show_9,
    show_keys=show_10,
    current_key=inputs.selected_key,
    angle=inputs.angle,
    shift_value=inputs.shift_value,
    flip_human_robot=flip)  # -> out, G_planned, G_built, G_supports, G_open_connectors, G_selected, G_planned_2, G_held_by_robot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; inputs current_key: Int32
# ---------- assembly_viz: Python ----------
import os
import sys
from scriptcontext import sticky as st
import Rhino.Geometry as rg

import math
from math import pi

from compas.geometry import Vector, Translation, Frame
from compas.artists import Artist
from compas.colors import Color

G_selected = []
G_planned = []
G_built = []
G_supports = []
G_held_by_robot = []
G_open_connectors = []
G_cones = []

connectors_ranges = []

option_vectors = []
origin_option_vectors = []
flip = 'AA'

key_tag_text = []
key_tag_location= []
lines = []

# Color coding
color_coding = {'color_is_planned': Color(1.0, 0.752941176471, 0.0, 1.0), 'color_is_support': Color(0.0, 0.0, 1.0, 1.0), 'color_has_open_connector': Color(0.494117647059, 1.0, 0.239215686275, 1.0), 'color_has_no_open_connectors': Color(0.78431372549, 0.78431372549, 0.78431372549, 1.0), 'color_is_built': Color(0.811764705882, 1.0, 0.709803921569, 1.0), 'color_is_built_by_robot': Color(0.686274509804, 0.878431372549, 0.862745098039, 1.0), 'color_is_built_by_human': Color(0.949019607843, 0.898039215686, 0.0, 1.0)}

keys = [key for key, element in assembly.elements()]
print len(keys)
lines = [Artist(assembly.element(key).line).draw() for key in keys]

open_connectors_frames = [assembly.element(key).connectors(state='open') for key in keys]
#open_connectors_ranges = [assembly.element(key).connectors_ranges(state='open') for key in keys]
#open_connectors_ranges = [Artist(connector).draw() for connectors in open_connectors_ranges for connector in connectors if connectors != []]

if show_open_connectors:
    open_connectors_planes = [Artist(connector).draw() for connectors in open_connectors_frames for connector in connectors if connectors != []]

def show(element, output_geo, color):
    mesh = Artist(element.mesh).draw(color)
    output_geo.append(mesh)

def show_multiple(elements, output_geo, color):
    for element in elements:
        mesh = Artist(element.mesh).draw(color)
        output_geo.append(mesh)

if assembly:
    radius = assembly.globals['rod_radius']
    
    if current_key != None:
        current_element = assembly.element(current_key)
        elem_options = assembly.element(current_key).current_option_elements(flip, angle, shift_value)
        G_selected = Artist(assembly.element(current_key).mesh).draw(color_coding['color_is_support'])
    else:
        current_element = None
        elem_options = []
    
    if len(elem_options) != 0:
        elem_option = elem_options[0]
    
    if flip_human_robot:
        elem_options.reverse()
    
        
    planned_keys = list(assembly.network.nodes_where({'is_planned':True}))
    built_keys = list(assembly.network.nodes_where({'is_built':True}))
    support_keys = assembly.support_keys
    built_keys = [key for key in built_keys if key not in assembly.open_connectors_keys and key not in support_keys]
    #support_keys = [key for key in support_keys if key not in assembly.open_connectors_keys]
    
    print 'planned keys:', planned_keys
    print 'built keys:', built_keys
    print 'support keys:', support_keys
    print 'open connectors keys:', assembly.open_connectors_keys
    
    planned_elements = [assembly.element(key) for key in planned_keys] 
    built_elements = [assembly.element(key) for key in built_keys if key not in assembly.last_added] 
    support_elements = [assembly.element(key) for key in support_keys] 
    open_connectors_elements = [assembly.element(key) for key in assembly.open_connectors_keys if key not in assembly.last_added]
    
    # Visualize assembly
    if show_assembly:
        for element in planned_elements:
            mesh = Artist(element.mesh).draw(color_coding['color_is_planned'])
            G_planned.append(mesh)
        for element in built_elements:
            mesh = Artist(element.mesh).draw(color_coding['color_has_no_open_connectors'])
            G_built.append(mesh)
        for element in support_elements:
            mesh = Artist(element.mesh).draw(color_coding['color_is_support'])
            G_supports.append(mesh)
        for element in open_connectors_elements:
            mesh = Artist(element.mesh).draw(color_coding['color_has_open_connector'])
            G_open_connectors.append(mesh)
    
    # Vizualize current connector 
    if show_option and show_assembly:
        if elem_options:
            show(elem_options[0], G_held_by_robot, color_coding['color_is_planned'])
            show(elem_options[1], G_planned, color_coding['color_is_planned'])
            
            print elem_options[0].line
        else:
            print('No open connectors')
    
    if show_last and show_assembly:
        if len(assembly.last_added) > 1:
            show(assembly.element(assembly.last_added[0]), G_held_by_robot, color_coding['color_has_open_connector'])
            show(assembly.element(assembly.last_added[1]), G_planned, color_coding['color_has_open_connector'])
        else:
            print('No open connectors')
    
    # Visualize all options
    if show_arrows and show_assembly:
        for key, o, v in assembly.current_options:
                option_vectors.append(rg.Vector3d(*tuple(v)))
                origin_option_vectors.append(rg.Point3d(o.x, o.y, o.z))
    
    elem_option_robot = Artist(elem_options[0].frame).draw() # elem for planning robot routine
    
    if show_keys:
        for key, element in assembly.elements():
            key_tag_text.append(str(key))
            key_tag_location.append(Artist(element.frame).draw().Origin)
            
    if show_support:
        G_supports.append(assembly.support)
# ---------- end assembly_viz ----------
rot = GhPythonScript(plane=assembly_viz.elem_option_robot, angle=Slider(245, range=0..360))  # -> out, plane
# ---------- rot: Python ----------
import math
from compas.geometry import Frame, Rotation
from compas.artists import Artist

frame = Frame(plane.Origin, plane.XAxis, plane.YAxis)

R = Rotation.from_axis_and_angle(frame.xaxis, math.radians(angle), frame.point)
frame.transform(R)

plane = Artist(frame).draw()
# ---------- end rot ----------
mesh_5 = Mesh(assembly_viz.G_planned_2)
mesh_6 = Mesh(assembly_viz.G_planned)
mesh_7 = Mesh(assembly_viz.G_built)
mesh_8 = Mesh(assembly_viz.G_supports)
mesh_9 = Mesh(assembly_viz.G_open_connectors)
mesh_10 = Mesh(assembly_viz.G_selected)
mesh_11 = Mesh(assembly_viz.G_held_by_robot)
vdis = VectorDisplay(Anchor=assembly_viz.origin_option_vectors, Vector=assembly_viz.option_vectors)
pln_6 = Plane(assembly_viz.open_connectors_planes)
tag = TextTag(Location=assembly_viz.key_tag_location, Text=assembly_viz.key_tag_text)
cir = Circle(Plane=pln_6, Radius=0.2)

# ----
# Configuration
# Block is red due to invalid inputs, though remains perfectly functional
inverse = PythonScript(robot=robot, group=info.main_group_name, plane_WCS=rot.plane, idx=select_configuration)  # -> out, plane_tool0_RCS, plane_tcp_RCS, configuration; inputs plane_WCS: Plane, idx: Int32
# ---------- inverse: Python ----------
import Rhino.Geometry as rg
import math
from compas.geometry import Frame, Transformation, Rotation
from compas_fab.robots import Configuration
from ur_fabrication_control.kinematics.ur_kinematics import inverse_kinematics
from ur_fabrication_control.kinematics.ur_params import ur_params
from compas_ghpython import draw_frame

tcp_WCS = Frame(plane_WCS.Origin, plane_WCS.XAxis, plane_WCS.YAxis)

# transform frame to robot coordinate system
print tcp_WCS
print plane_WCS
#tcp_RCS = robot.RCF_in_WCF.to_local_coordinates(tcp_WCS)
tcp_BCS = robot.to_local_coordinates(tcp_WCS)
#tcp_BCS = tcp_WCS.transformed(robot.transformation_WCF_BCF())
tcp_RCS = tcp_BCS.transformed(robot.transformation_RCF_BCF().inverse())

tool0_RCS = robot.from_tcf_to_t0cf([tcp_RCS])[0]
print tcp_RCS
print tool0_RCS
plane_tool0_RCS = draw_frame(tool0_RCS)
plane_tcp_RCS = draw_frame(tcp_RCS)
# calculate solutions to frame
ur_params = ur_params["ur10e"] # get the parameters according to the robot model
print ur_params
solutions = inverse_kinematics(tool0_RCS, ur_params)
print solutions

if not len(solutions):
    joint_values = [0,0,0,0,0,0]
    configuration = Configuration.from_revolute_values(joint_values)
else:
    joint_values = solutions[idx]
    #print joint_values
    
    ### ***** HACK ***** ##### TODO: CHECK!!!
    for i, v in enumerate(joint_values):
        if v > math.pi:
            v -= 2*math.pi
        if v < -math.pi:
            v += 2*math.pi
        joint_values[i] = v
    ### ***** HACK ***** ##### TODO: CHECK!!!
    configuration = [Configuration.from_revolute_values(joint_values)]

print(configuration)
# ---------- end inverse ----------

list_6 = ValueList({"0 forward_kinematics": 0, "1 inverse_kinematics": 1}, selected="1 inverse_kinematics")
filter = StreamFilter(Gate=list_6, Stream0=forward_kinematics, Stream1=inverse.configuration)

# ----
# Visualisation
show_end_effector_frame = BooleanToggle(False)
show_base_frame = BooleanToggle(False)
show_collision = BooleanToggle(False)
show_frames = BooleanToggle(False)
show_visual = BooleanToggle(True)
show_acm = BooleanToggle(False)
list_7 = ValueList({"Zero": 0, "One": 1, "Two": 2, "Three": 3, "Four": 4, "Five": 5}, selected="Zero")
visualize = PythonScript(
    robot=robot,
    tool=tool.tool,
    group=info.main_group_name,
    configuration=filter,
    redraw=[attach_remove.bang, set_base_frame],
    show_visual=show_visual,
    show_collision=show_collision,
    show_end_effector_frame=show_end_effector_frame,
    show_frames=show_frames,
    show_base_frame=show_base_frame,
    show_acm=show_acm,
    station=list_7)  # -> out, robot, visual, collision, attached_meshes, frames, ee_frame, tool0_frame, base_frame, base_pt; inputs redraw: list, attached_collision_meshes: list, station_pts: list
# ---------- visualize: Python ----------
import rhinoscriptsyntax as rs
import Rhino.Geometry as rg
import ghpythonlib.components as ghcomp
from compas.geometry import Vector
from compas.geometry import Point
from compas.geometry import Transformation
from compas.geometry import Frame
from compas_ghpython.artists import MeshArtist
from compas_ghpython.utilities import draw_frame
from compas_fab.robots import Configuration
from ur_fabrication_control.kinematics.ur_kinematics import forward_kinematics
from ur_fabrication_control.kinematics.ur_params import ur_params

print(configuration)

if robot and configuration:
    robot.update(configuration, visual=show_visual, collision=show_collision)
    ur_params = ur_params[robot.main_group_name]
    print(ur_params)
    if show_visual:
        visual = robot.artist.draw_visual()
        robot_BCF = draw_frame(robot.BCF) 
        init_robot_plane = rg.Plane.WorldXY
        #robot_RCF = draw_frame(robot.RCF_in_WCF)
        #init_robot_plane = rg.Plane(rg.Point3d(0.275, 0.0, 1.105), rg.Vector3d(-0.707, 0.707, 0.0), rg.Vector3d(-0.707, -0.707,0.0))
        #visual = ghcomp.Orient(visual, init_robot_plane, robot_RCF)[0]
        visual = ghcomp.Orient(visual, init_robot_plane, robot_BCF)[0]
        
    if show_collision:
        collision = robot.artist.draw_collision()
    
    frames = robot.transformed_frames(configuration, group)

    if show_base_frame:
        base_frame = frames[0]

    if show_end_effector_frame:
#        tool0_frame = forward_kinematics(configuration.revolute_values, ur_params)
        ee_frame = robot.forward_kinematics(configuration, group)
        print ee_frame
        if robot.attached_tool:
            tool0_frame = robot.from_tcf_to_t0cf([ee_frame])
        print("End-effector", ee_frame)
    
    if not show_frames:
        frames = None

#    frame = forward_kinematics(configuration.revolute_values, ur_params)
    frame = robot.forward_kinematics(configuration, options=dict(solver='model'))
    #robot.artist.update_tool(visual=visual, collision=collision, transformation=Transformation.from_frame_to_frame(Frame.worldXY(), tool0_frame))
    
    if show_acm:
        M = []
        for acm in attached_collision_meshes:
            frame = robot.forward_kinematics(configuration, options=dict(solver='model', link_name=acm.link_name))
            T = Transformation.from_frame_to_frame(Frame.worldXY(), frame)
            mesh = acm.collision_mesh.mesh.transformed(T)
            M.append(MeshArtist(mesh).draw())
        attached_meshes = M
# ---------- end visualize ----------
geo = Geometry(visualize.collision)
geo_2 = Geometry(visualize.visual)
draw_2 = GhPythonScript(frames=[visualize.frames, visualize.ee_frame, visualize.base_frame], scale=Slider(0.1, range=0..1))  # -> P, V, C, W; inputs frames: list
# ---------- draw_2: Python ----------
from System.Drawing import Color
from compas_ghpython.utilities import draw_frame

red = Color.FromArgb(255, 0, 0)
green = Color.FromArgb(0, 255, 0)
blue = Color.FromArgb(0, 0, 255)

P = []
V = []
C = []

scale = float(scale)

for frame in frames:
    if not frame:
        continue
    plane = draw_frame(frame)
    P += [plane.Origin] * 3
    V.append(plane.XAxis * scale)
    V.append(plane.YAxis * scale)
    V.append(plane.ZAxis * scale)
    C += [red, green, blue]

W = 3
# ---------- end draw_2 ----------
preview = CustomPreview(Geometry=geo_2, Shader=ColourSwatch(SwatchColor=RGB(105, 105, 105)))
preview_2 = CustomPreview(Geometry=visualize.attached_meshes, Shader=ColourSwatch(SwatchColor=RGB(255, 255, 255)))
vdisex = VectorDisplayEx(Point=draw_2.P, Vector=draw_2.V, Colour=draw_2.C, Width=draw_2.W)

# ----
# Network Visualization
number_slider_3 = Slider(0, range=0..47)
show_11 = BooleanToggle(False)
network_viz = GhPythonScript(assembly=aggregate_2.assembly, show_network=show_11, key=number_slider_3)  # -> out, nodes, edges, current_node, current_node_neighbors; inputs key: Int32
# ---------- network_viz: Python ----------
import sys, os
import ghpythonlib.components as ghcomp
from compas.datastructures import Network
from compas_ghpython.artists import NetworkArtist
from compas_rhino.geometry import RhinoLine

import compas_ghpython
import Rhino.Geometry as rg


data = assembly.network.to_data()
network = Network.from_data(data)

print assembly.network.number_of_nodes()

def draw_network(network):
    """Draw a network in Grasshopper.
    """
    points = []
    for key, attr in network.nodes(True):
        points.append({
            'pos': network.node_coordinates(key),
        })

    lines = []
    for (u, v), attr in network.edges(True):
        lines.append({
            'start': network.node_coordinates(u),
            'end': network.node_coordinates(v),
        })

    points_rg = compas_ghpython.draw_points(points)
    lines_rg = compas_ghpython.draw_lines(lines)

    return points_rg, lines_rg

if show_network:
    nodes, edges = draw_network(network)
    
    current_node = {'pos': network.node_coordinates(key), 'radius': 0.03}
    current_node = compas_ghpython.draw_spheres([current_node])
    
    current_node_neighbors_keys = network.neighbors(key)
    current_node_neighbors = [{'pos': network.node_coordinates(key), 'radius': 0.02} for key in current_node_neighbors_keys]
    current_node_neighbors = compas_ghpython.draw_spheres(current_node_neighbors)
# ---------- end network_viz ----------
pt_4 = Point(network_viz.nodes)
line = Line(network_viz.edges)
brep_3 = Brep(network_viz.current_node)
brep_4 = Brep(network_viz.current_node_neighbors)
preview_3 = CustomPreview(Geometry=brep_4, Material=ColourSwatch(SwatchColor=RGB(255, 207, 207)))
preview_4 = CustomPreview(Geometry=[brep_3, line], Material=ColourSwatch(SwatchColor=RGB(0, 0, 0)))

# ----
# Export .json
export = Button()
export_2 = Button()
export_3 = PythonScript(DATA=py.DATA, assembly=aggregate_2.assembly, export_to_json=export, export_to_json_unity=export_2)
# ---------- export_3: Python ----------
import os
from compas.datastructures.mesh import mesh_quads_to_triangles
from compas.datastructures.mesh import mesh_unify_cycles

if export_to_json:
    filename = "equilibrium_50_4p_3.json"
    PATH = os.path.join(DATA, "assembly", filename)
    
    # the assembly has to be serialized such that it can be called from CPython, True to enable pretty print
    assembly.to_json(PATH, True)
    

if export_to_json_unity:
    
    for key, e in assembly.elements():
    
        #convert to trimesh
        mesh_quads_to_triangles(e._mesh, check_angles=False)
        #mesh_unify_cycles(e._mesh)
        #print e._mesh.faces
        #print e._mesh.face_vertices(list(e._mesh.faces())[0])

    filename = "unity_assembly_test.json"
    PATH = os.path.join(DATA, "assembly", filename)
    assembly.to_json(PATH)
# ---------- end export_3 ----------

panel_7 = Panel(visualize.visual)
