# Grasshopper definition ex8_firebase_communication.ghx (Grasshopper 1.0.7)

# ----
# Define QRcode markers positions
spacing = Slider(2.35, range=0..10)
distancefromwall = Slider(3.2, range=0..10)
height = Slider(1.3, range=0..10)
cluster = Cluster_2(A=spacing, factor=distancefromwall, data_2="2", B=height)

plane = Plane(flatten(cluster))

# ----
# 1. Define local path
panel = Panel("C:/Users/eleni/Documents/GitHub/cdf_unity")
# GH to FIREBASE STORAGE
panel_2 = Panel("C:/Users/josep/OneDrive/Desktop/mas_dfab_22_23/mas_dfab_t3/git_working/git_original/cdf_unity")
data = Data(panel)

bang = Button()
panel_3 = Panel("Unload libraries")
unload = PythonScript(bang=bang)
# ---------- unload: Python ----------
from compas_rhino.utilities.misc import get_tolerance
from compas_rhino.utilities.misc import unload_modules

unload_modules("compas")
unload_modules("assembly_information_model")
unload_modules("cdf_unity")
# ---------- end unload ----------

# ----
# Joints file
panel_4 = Panel("trunk_1_app_test_joints.json")
# Assembly file
panel_5 = Panel("assembly_d2_assembly.json")
info = Info()  # -> info
#   port info: Environment info.
# ---------- info: Python ----------
"""
Displays information about the active COMPAS environment.
"""
import compas_bootstrapper
from ghpythonlib.componentbase import executingcomponent as component

import compas


class CompasInfo(component):
    def RunScript(self):
        self.Message = "COMPAS v{}".format(compas.__version__)
        info = "COMPAS Version: {}\nEnvironment: {}"
        return info.format(compas.__version__, compas_bootstrapper.ENVIRONMENT_NAME)
# ---------- end info ----------

# ----
# 3. Pick a .json file from storage
# to upload it to realtime_database
# Joints file
panel_6 = Panel("trunk_1_app_test_joints.json")
keystoupload = Panel("""dna
node""")
keystoupload_2 = Panel("joint")
parentname = Panel("Design")
parentname_2 = Panel("Joints")
py = PythonScript(path=data)  # -> DATA
# ---------- py: Python ----------
import os
import getpass

username = getpass.getuser()
DATA = os.path.abspath(os.path.join(path + "/data"))

print(username)
print(DATA)
# ---------- end py ----------

# ----
# GH to REALTIME DATABASE
# Assembly file
panel_7 = Panel("assembly_d2_assembly.json")

# ----
# QR code markers positions
# provide the positions
# of the QRcode markers
# as planes
plane_2 = Plane(flatten(plane))

# ----
# Visualize QR markers
qrcode_markers_dimensions = Slider(0.15, range=0..1)
cluster_2 = Cluster_3(A=qrcode_markers_dimensions, base=plane_2)  # -> box, list_a

panel_8 = Panel(info)

# ----
# Upload QRcode  positions
# to Realtime Database
panel_9 = Panel("qrframes.json")
ghpython_script = GhPythonScript(planes=plane_2)  # -> list; inputs planes: list
# ---------- ghpython_script: Python ----------
import compas.geometry as cg
from compas_rhino.conversions import plane_to_compas_frame

list =[]
frames=[]
q =[]
for p in planes:
    f = plane_to_compas_frame(p)
    frames.append(f)
    a = f.to_data()
    a["quaternion"] =[f.quaternion.w, f.quaternion.x, f.quaternion.y, f.quaternion.z] 
    list.append(a)

#list = zip(frames,q)

print list
# ---------- end ghpython_script ----------
ghpython_script_2 = GhPythonScript(path=py, file_name=panel_9)  # -> path
# ---------- ghpython_script_2: Python ----------
a = ghdoc.Path

path =path + '\\'+  file_name
# ---------- end ghpython_script_2 ----------
to_json = ToJSON(data=ghpython_script, filepath=ghpython_script_2, pretty=Toggle(True))  # -> json; inputs data: list, pretty: Boolean
#   port data: COMPAS data objects to serialize.
#   port filepath: File path where to store the JSON file. If empty, it will not store to disk but instead return the JSON string.
#   port pretty: If True, JSON data will be formatted with indentation and key sorting.
#   port json: JSON file path or JSON string.
# ---------- to_json: Python ----------
"""
Serializes COMPAS objects to JSON.
"""
from ghpythonlib.componentbase import executingcomponent as component

import compas


class CompasInfo(component):
    def RunScript(self, data, filepath, pretty):
        json = filepath
        print (data)
        if filepath:
            compas.json_dump(data, filepath, pretty)
        else:
            json = compas.json_dumps(data, pretty)
        return json
# ---------- end to_json ----------
connect = BooleanToggle(True)
upload = Button()
upload_2 = PythonScript(path=data, json=to_json, upload=upload, connect=connect)  # inputs connect: Boolean
# ---------- upload_2: Python ----------
import os
import os
import compas
from compas.rpc import Proxy
from compas_rhino.conversions import plane_to_compas_frame


if connect:
    p = Proxy(package = 'cdf_unity.firebase.realtime_database', path=path +'\src')
    p.stop_server()
    p.start_server()
    print (p)

if upload:
    p.set_qr_frames(json)
# ---------- end upload_2 ----------

# ----
# 2. Define a .json
# to upload it to storage
data_2 = Data(panel_5)

ghpython_script_3 = GhPythonScript(
    filename=data_2,
    nameA=panel_5,
    pNameA=parentname,
    pKeysA=keystoupload,
    nameJ=panel_4,
    pNameJ=parentname_2,
    pKeysJ=keystoupload_2)  # -> out, keys, pname; inputs pKeysA: list, pKeysJ: list
# ---------- ghpython_script_3: Python ----------
if filename == nameA:
    keys = pKeysA
    pname = pNameA
elif filename == nameJ:
    keys = pKeysJ
    pname = pNameJ
# ---------- end ghpython_script_3 ----------

# ----
# Manually Placed
geometry = Geometry([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])

# ----
# upload  to REALTIME DATABASE
connect_2 = BooleanToggle(False)
upload_3 = Button()
upload_4 = PythonScript(
    DATA=py,
    path=data,
    filename=data_2,
    upload=upload_3,
    connect=connect_2,
    keys=ghpython_script_3.keys,
    parentname=ghpython_script_3.pname)  # -> stored_json; inputs connect: Boolean, keys: list
# ---------- upload_4: Python ----------
import os
import os
from compas.rpc import Proxy
import json

print keys
print type(parentname)
PATH = os.path.join(DATA, filename)
path_on_cloud = filename
path_local = PATH
path_stored = (path_local[:-5] + "_stored.json")

if connect:
    p = Proxy(package = 'cdf_unity.firebase.realtime_database', path=path +'\src')
    p.stop_server()
    p.start_server()
    print (p)
    
    q =Proxy(package='cdf_unity.firebase.storage', path=path +'\src') 
    q.stop_server()
    q.start_server()

if upload:
    
    q.download_from_firebase(path_on_cloud, path_stored )
    p.set_json_data(path_stored, parentname, keys)

with open(path_stored) as json_file:
    stored_json = [json.load(json_file)]
# ---------- end upload_4 ----------

# ----
# upload .json to STORAGE
py_2 = PythonScript(path=data)  # -> DATA; same code as py
upload_5 = Button()
connect_3 = BooleanToggle(True)
upload_6 = PythonScript(DATA=py_2, path=data, filename=data_2, upload=upload_5, connect=connect_3)  # inputs connect: Boolean
# ---------- upload_6: Python ----------
import os
from compas.datastructures.mesh import mesh_quads_to_triangles
from compas.datastructures.mesh import mesh_unify_cycles
from compas.rpc import Proxy

path_on_cloud = str(filename)
PATH = os.path.join(DATA, filename)
print PATH

if connect:
    p = Proxy(package='cdf_unity.firebase.storage', path=path +'\src') 
    p.stop_server()
    p.start_server()
if upload:
    PATH = os.path.join(DATA, filename)
    print (filename)
    path_on_cloud = filename
    path_local = PATH
    print(path_local)
    p.upload_to_firebase(path_on_cloud, path_local)
# ---------- end upload_6 ----------

# ----
# For ARApp
colour_swatch = ColourSwatch(SwatchColor=RGB(153, 0, 255))
custom_preview = CustomPreview(Geometry=cluster_2.box, Material=colour_swatch)

# ----
# For Robot
colour_swatch_2 = ColourSwatch(SwatchColor=RGB(34, 91, 140))
custom_preview_2 = CustomPreview(Geometry=[cluster_2.list_a, geometry], Material=colour_swatch_2)

# ----
# REALTIME DATABASE  to GH
connect_4 = BooleanToggle(True)
update_keys_built = Trigger(Interval=2, TimerInterval=5, Target=read)  # disabled
read = GhPythonScript(path=data, stored_json=upload_4, connect=connect_4)  # -> out, realtime_json_data, current_index; inputs connect: Boolean
# ---------- read: Python ----------
import os
from compas.rpc import Proxy

if connect:
    p = Proxy(package = 'cdf_unity.firebase.realtime_database', path=path +'\src')
    
    p.stop_server()
    p.start_server()
    
    stored_json.update({"node": p.get_json_data("Design", "node")})
    realtime_json_data = [stored_json]
    current_index = p.get_json_data("Design", "currentstick")
# ---------- end read ----------
panel_10 = Panel(read.out)

currentstick = Panel(read.current_index)

# ----
# Dictionary with all the data
# only the "node" data are updating
# based on the realtime database
data_3 = Data(read.realtime_json_data)

length = Slider(0.9, range=0..100)
radius = Slider(0.015, range=0..100)

# ----
# PREVIEW CHANGES ON REALTIME
# Import and make frames from JSON
ghpython_script_4 = GhPythonScript(json=data_3)  # -> out, built_frames, unbuilt_frames
# ---------- ghpython_script_4: Python ----------
import compas.geometry
from compas.geometry import Vector
from compas import json_load
from compas.artists import Artist

unbuilt_frames = []
built_frames = []
for key in json['node']:
    print key
    point = json['node'][key]['element']['frame']['point']
    xaxis = json['node'][key]['element']['frame']['xaxis']
    yaxis = json['node'][key]['element']['frame']['yaxis']
    zaxis = Vector.cross(Vector(xaxis[0],xaxis[1], xaxis[2]), Vector(yaxis[0], yaxis[1], yaxis[2]))
    frame = compas.geometry.Frame(point, yaxis, zaxis)
    plane = Artist(frame).draw()

    status = json['node'][key]["is_built"]
    if status:
        built_frames.append(plane)
    else:
        unbuilt_frames.append(plane)
# ---------- end ghpython_script_4 ----------

# ----
# Geometry for instance
cluster_3 = Cluster(radius=radius, data=length)  # -> point, cylinder_2

# ----
# Built
orient = Orient(Geometry=cluster_3.cylinder_2, Source=cluster_3.point, Target=ghpython_script_4.built_frames)  # -> Geometry, Transform
custom_preview_3 = CustomPreview(Geometry=orient.Geometry, Material=ColourSwatch(SwatchColor=RGBA(94, 94, 94, 226)))

# ----
# Unbuilt
orient_2 = Orient(Geometry=cluster_3.cylinder_2, Source=cluster_3.point, Target=ghpython_script_4.unbuilt_frames)  # -> Geometry, Transform
custom_preview_4 = CustomPreview(Geometry=orient_2.Geometry, Material=ColourSwatch(SwatchColor=RGBA(250, 250, 250, 154)))

# ==== cluster Cluster
data = ClusterInput()
data_2 = Data(data)
division = Division(A=data_2, B=2)
unit_z = UnitZ(Factor=division)
construct_point = ConstructPoint(XCoordinate=0, YCoordinate=0, ZCoordinate=0)
negative = Negative(Value=unit_z)
move = Move(Geometry=construct_point, Motion=negative)  # -> Geometry, Transform
point = ClusterOutput(construct_point)
radius = ClusterInput()
cylinder = Cylinder(Base=move.Geometry, Radius=radius, Length=data_2)
cylinder_2 = ClusterOutput(cylinder)

# ==== cluster Cluster_2
A = ClusterInput()
division = Division(A=A, B=2)
data = Data(division)
negative = Negative(Value=data)
B = ClusterInput()
data_2 = ClusterInput()
data_3 = Data(negative)
absolute = Absolute(Value=data_3)
addition = Addition(A=data, B=B)
data_4 = Data(data_2)
construct_domain = ConstructDomain(DomainStart=data_3, DomainEnd=absolute)
construct_point = ConstructPoint(XCoordinate=0, YCoordinate=0, ZCoordinate=0)
unit_y = UnitY(Factor=data_3)
unit_z = UnitZ(Factor=addition)
unit_x = UnitX(Factor=data_3)
rectangle = Rectangle(Plane=PlaneXY(0, 0, 0), XSize=construct_domain, YSize=construct_domain, Radius=0)  # -> Rectangle, Length
addition_2 = Addition(A=unit_x, B=unit_y)
move = Move(Geometry=construct_point, Motion=addition_2)  # -> Geometry, Transform
rectangular_array = RectangularArray(Geometry=move.Geometry, Cell=rectangle.Rectangle, XCount=data_4, YCount=data_4)  # -> Geometry, Transform
factor = ClusterInput()
unit_y_2 = UnitY(Factor=factor)
plane = Plane(rectangular_array.Geometry)

split_list = SplitList(List=plane, Index="3")  # -> ListA, ListB
data_5 = Data(split_list.ListA)
insert_items = InsertItems(List=data_5, Item=split_list.ListB, Indices="2", Wrap=True)

move_2 = Move(Geometry=insert_items, Motion=unit_y_2)  # -> Geometry, Transform
bounding_rectangle = BoundingRectangle(Geometry=move_2.Geometry, Plane=PlaneXY(0, 0, 0), Axis=0, Slide=0, Union=True)  # -> Bounding, DimensionX, DimensionY
area = Area(Geometry=bounding_rectangle.Bounding)  # -> Area, Centroid
deconstruct = Deconstruct(Point=area.Centroid)  # -> XComponent, YComponent, ZComponent
construct_point_2 = ConstructPoint(XCoordinate=deconstruct.XComponent, YCoordinate=deconstruct.YComponent, ZCoordinate=0)
yz_plane = YZPlane(Origin=construct_point_2)
rotate = Rotate(Geometry=move_2.Geometry, Angle=1.570796327, Plane=yz_plane)  # -> Geometry, Transform
move_3 = Move(Geometry=rotate.Geometry, Motion=unit_z)  # -> Geometry, Transform
merge = Merge(Data1=insert_items, Data2=move_3.Geometry)
result = ClusterOutput(merge)

# ==== cluster Cluster_3
A = ClusterInput()
division = Division(A=A, B=2)
multiplication = Multiplication(A=division, B=2)
unit_x = UnitX(Factor=multiplication)
base = ClusterInput()
center_box = CenterBox(Base=base, X=division, Y=division, Z="0.005")
move = Move(Geometry=center_box, Motion=unit_x)  # -> Geometry, Transform
split_list = SplitList(List=move.Geometry, Index="6")  # -> ListA, ListB
box = ClusterOutput(center_box)
list_a = ClusterOutput(split_list.ListA)
