# Grasshopper definition ex9_assembly_sequence.ghx (Grasshopper 1.0.7)

# ----
# Color Coding
colour_swatch = ColourSwatch(SwatchColor=RGB(255, 192, 0))
color_coding = GhPythonScript(
    is_planned=colour_swatch,
    is_built=ColourSwatch(SwatchColor=RGB(207, 255, 181)),
    is_support=ColourSwatch(SwatchColor=RGB(0, 0, 255)),
    has_open_connector=ColourSwatch(SwatchColor=RGB(126, 255, 61)),
    has_no_open_connectors=ColourSwatch(SwatchColor=RGB(200, 200, 200)),
    is_built_by_robot=ColourSwatch(SwatchColor=RGB(175, 224, 220)),
    is_built_by_human=ColourSwatch(SwatchColor=RGB(242, 229, 0)))  # -> out, color_coding
# ---------- color_coding: Python ----------
import rhinoscriptsyntax as rs
from compas.colors import Color


color_is_planned = Color(is_planned.R/255 , is_planned.G/255, is_planned.B/255)
color_is_built = Color(is_built.R/255 , is_built.G/255, is_built.B/255)
color_is_support = Color(is_support.R/255 , is_support.G/255, is_support.B/255)
color_has_open_connector = Color(has_open_connector.R/255 , has_open_connector.G/255,has_open_connector.B/255)
color_has_no_open_connectors = Color(has_no_open_connectors.R/255 , has_no_open_connectors.G/255, has_no_open_connectors.B/255)
color_is_built_by_robot = Color(is_built_by_robot.R/255 , is_built_by_robot.G/255, is_built_by_robot.B/255)
color_is_built_by_human = Color(is_built_by_human.R/255 , is_built_by_human.G/255, is_built_by_human.B/255)

color_coding = {'color_is_planned':color_is_planned, 'color_is_built':color_is_built, 'color_is_support':color_is_support, 'color_has_open_connector':color_has_open_connector, 'color_has_no_open_connectors':color_has_no_open_connectors, 'color_is_built_by_robot':color_is_built_by_robot, 'color_is_built_by_human':color_is_built_by_human}

print color_coding
# ---------- end color_coding ----------
panel = Panel(color_coding.out)

py = PythonScript()  # -> ENVIRONMENT_NAME, HERE, DATA
# ---------- py: Python ----------
import os
import compas_bootstrapper

HERE = os.path.dirname(ghdoc.Path)
DATA = os.path.abspath(os.path.join(HERE, "..", "data"))
ENVIRONMENT_NAME = compas_bootstrapper.ENVIRONMENT_NAME
print(HERE)
print(DATA)
print(ENVIRONMENT_NAME)
# ---------- end py ----------

panel_2 = Panel("Unload libraries")
bang = Button()
unload = PythonScript(bang=bang)
# ---------- unload: Python ----------
from compas_rhino.utilities.misc import get_tolerance
from compas_rhino.utilities.misc import unload_modules

unload_modules("cdf_2023")
unload_modules("mobile_robot_control")
# ---------- end unload ----------

# ----
# Load assembly model
# Import assembly from .json.
import = Button(ExpressionNormal="True", ExpressionPressed="False")
initial_assembly = GhPythonScript(DATA=py.DATA, filename="trunk_1_assembly.json", import_from_json=import)  # -> out, assembly; inputs import_from_json: Boolean
# ---------- initial_assembly: Python ----------
import os
import json
from scriptcontext import sticky

from cdf_2023.assembly import Assembly

if import_from_json:
    PATH = os.path.join(DATA, "assembly", filename)
    assembly = Assembly.from_json(PATH)
    assembly.support_keys = []

# create a dictionary to store global value in 
assembly.globals = {}

# define global values
assembly.globals['rod_radius'] = 0.011
assembly.globals['rod_length'] = 0.6
assembly.globals['rf_unit_offset'] = 0.2
assembly.globals['rf_unit_radius'] = 0.15
# ---------- end initial_assembly ----------

panel_3 = Panel(py.ENVIRONMENT_NAME)

key = Slider(16, range=0..388)
till_key = Button()
reset = Button()
start = Button()
stop = Button()
step = Button()
full = Button()
list = ValueList({"20", "50", "100", "500", "1000", "5000"}, selected="50")

back = Button()
counter = CountThroughList(
    assembly=initial_assembly.assembly,
    start=start,
    stop=stop,
    step=step,
    step_back=back,
    reset=reset,
    full=full,
    till_key=till_key,
    key=key,
    interval=list)  # -> item, counter; inputs start: Boolean, stop: Boolean, step_back: Boolean, key: Int32
# ---------- counter: Python ----------
from scriptcontext import sticky as st
from compas_ghpython import update_component


L = list(assembly.elements())
# store data in component
guid = str(ghenv.Component.InstanceGuid)
counter_key = "counter_" + guid
running_key = "running_" + guid

if counter_key not in st:
    st[counter_key] = 0

if running_key not in st:
    st[running_key] = False
    

if st[running_key]:
    if st[counter_key] < len(L) - 1:
        st[counter_key] += 1
        update_component(ghenv, interval)
    else:
        st[counter_key] = 0
        st[running_key] = False
    
    
if start:
    st[running_key] = True

if stop:
    st[running_key] = False

if step:
    if st[counter_key] < len(L) - 1:
        st[counter_key] += 1

if step_back:
    if st[counter_key] < len(L):
        st[counter_key] -= 1

if reset:
    st[counter_key] = 0

if till_key:
    st[counter_key] = key

if full:
    st[counter_key] = len(L)-1

if len(L):
    item = L[st[counter_key]]



#st["visualisation_counter"] = st[counter_key]
#st[counter_key]= 500
counter = st[counter_key]
# ---------- end counter ----------

counter_2 = Panel(counter.counter)

stats = GhPythonScript(assembly=initial_assembly.assembly)  # -> out
# ---------- stats: Python ----------
total_elements = assembly.network.number_of_nodes()
planned_keys = list(assembly.network.nodes_where({'is_planned':True}))
built_keys = list(assembly.network.nodes_where({'is_built':True}))
support_keys = list(assembly.network.nodes_where({'is_support':True}))

print total_elements, "element(s) in assembly."
print len(built_keys), "element(s) are already built."
print len(planned_keys), "element(s) are planned."
print len(support_keys), "element(s) are suppports."

keys = [key for key, element in assembly.elements()]
open_connectors_keys = [key for key in keys if assembly.element(key).connectors(state='open')]
closed_connectors_keys = [key for key in keys if key not in open_connectors_keys]

#print len(open_connectors_keys), 'open connectors'
#print len(closed_connectors_keys), 'closed connectors'

edges = assembly.network.number_of_edges()
# ---------- end stats ----------
panel_4 = Panel(stats)

show = BooleanToggle(False)

# ----
# Assembly visualization
# 1. Visualize assembly.
# 2. Visualize selected element.
# 3. Visuilize built/planned and supports.
show_2 = BooleanToggle(False)
show_3 = BooleanToggle(True)
show_4 = BooleanToggle(True)
show_5 = BooleanToggle(True)
show_6 = BooleanToggle(True)
show_7 = BooleanToggle(True)
assembly_viz = PythonScript(
    assembly=initial_assembly.assembly,
    show_assembly=show_2,
    show_counter=show,
    show_planned=show_4,
    show_built=show_5,
    show_supports=show_3,
    show_selected=show_6,
    show_keys=show_7,
    current_key=counter.counter)  # -> out, G_planned, G_built, G_supports, G_selected, key_tag_location, key_tag_text, robot_base_plane, selected_elem_plane; inputs current_key: Int32
# ---------- assembly_viz: Python ----------
import os
import sys
from scriptcontext import sticky as st
import Rhino.Geometry as rg

import math

from compas.artists import Artist
from compas.colors import Color
from compas_ghpython import draw_frame

G_selected = []
G_planned = []
G_built = []
G_supports = []

flip = 'AA'

key_tag_text = []
key_tag_location= []

# Color coding
color_coding = {'color_close_pairs': Color(1.0, 0., 0.0, 1.0),
                'color_is_planned': Color(1.0, 0.752941176471, 0.0, 1.0), 
                'color_is_support': Color(0.0, 0.0, 1.0, 1.0), 
                'color_has_open_connector': Color(0.494117647059, 1.0, 0.239215686275, 1.0), 
                'color_has_no_open_connectors': Color(0.78431372549, 0.78431372549, 0.78431372549, 1.0), 
                'color_is_built': Color(0.811764705882, 1.0, 0.709803921569, 1.0), 
                'color_is_built_by_robot': Color(0.686274509804, 0.878431372549, 0.862745098039, 1.0), 
                'color_is_built_by_human': Color(0.949019607843, 0.898039215686, 0.0, 1.0)}


def show(element, output_geo, color):
    mesh = Artist(element.mesh).draw(color)
    output_geo.append(mesh)

def show_multiple(elements, output_geo, color):
    for element in elements:
        mesh = Artist(element.mesh).draw(color)
        output_geo.append(mesh)

radius = assembly.globals['rod_radius']

if current_key != None:
    current_element = assembly.element(current_key)
else:
    current_element = None
    
if show_selected: 
    G_selected = Artist(assembly.element(current_key).mesh).draw(color_coding['color_is_support'])

all_keys = [key for key, element in assembly.elements()]
planned_keys = list(assembly.network.nodes_where({'is_planned':True}))
built_keys = list(assembly.network.nodes_where({'is_built':True}))
support_keys = list(assembly.network.nodes_where({'is_support':True}))

print 'all_keys', all_keys
print 'planned keys:', planned_keys
print 'built keys:', built_keys
print 'support keys:', support_keys

all_elements = [assembly.element(key) for key in all_keys]
planned_elements = [assembly.element(key) for key in planned_keys] 
built_elements = [assembly.element(key) for key in built_keys] 
support_elements = [assembly.element(key) for key in support_keys] 
    
    
if show_counter and not show_assembly:
    # Visualize till counter
    for element in all_elements[:current_key]:
        mesh = Artist(element.mesh).draw(color_coding['color_has_no_open_connectors'])
        G_planned.append(mesh)


if show_assembly and not show_counter:
    # Visualize assembly
    if show_assembly and show_planned:
        for element in planned_elements:
            mesh = Artist(element.mesh).draw(color_coding['color_is_planned'])
            G_planned.append(mesh)
    if show_assembly and show_built:
        for element in built_elements:
            mesh = Artist(element.mesh).draw(color_coding['color_is_built'])
            G_built.append(mesh)
    if show_assembly and show_supports:
        for element in support_elements:
            mesh = Artist(element.mesh).draw(color_coding['color_is_support'])
            G_supports.append(mesh)

if show_keys:
    for key, element in assembly.elements():
        key_tag_text.append(str(key))
        key_tag_location.append(Artist(element.frame).draw().Origin)

selected_elem_plane = draw_frame(assembly.element(current_key).frame)
if assembly.network.node_attribute(current_key, 'robot_frame') != False:
    robot_base_plane = draw_frame(assembly.network.node_attribute(current_key, 'robot_frame'))
# ---------- end assembly_viz ----------
rot = GhPythonScript(plane=assembly_viz.selected_elem_plane, angle=Slider(0, range=0..360))  # -> out, plane
# ---------- rot: Python ----------
import math
from compas.geometry import Frame, Rotation
from compas.artists import Artist

frame = Frame(plane.Origin, plane.XAxis, plane.YAxis)

R = Rotation.from_axis_and_angle(frame.xaxis, math.radians(angle), frame.point)
frame.transform(R)

plane = Artist(frame).draw()
# ---------- end rot ----------
mesh = Mesh(assembly_viz.G_built)
mesh_2 = Mesh(assembly_viz.G_selected)
mesh_3 = Mesh(assembly_viz.G_planned)
mesh_4 = Mesh(assembly_viz.G_supports)
tag = TextTag(Location=assembly_viz.key_tag_location, Text=assembly_viz.key_tag_text)

# ---- group: capture
viewport_name = Text("workflow_2")
capture_to_bitmap = PythonScript(DATA=py.DATA, capture=Button(), viewport_name=viewport_name, idx=Slider(2, range=0..10))  # -> out, a; inputs capture: Boolean, idx: Int32
# ---------- capture_to_bitmap: Python ----------
import Rhino
import System.Drawing
from scriptcontext import sticky as st

import sys, os
import ghpythonlib.components as ghcomp
import Grasshopper as gh
import datetime


ghComp = ghenv.Component
ghDoc = ghComp.OnPingDocument()

def rCommonCap(filePath, viewportName,scaleFactor):
    RhinoDocument = Rhino.RhinoDoc.ActiveDoc
    view = RhinoDocument.Views.Find(viewportName, False)
    vp = view.ActiveViewport
    size = System.Drawing.Size(vp.Size.Width*scaleFactor,vp.Size.Height*scaleFactor)
    capture = view.CaptureToBitmap(size)
    capture.Save(filePath);


export_dir = os.path.join(DATA, 'parameter_studies')
if not os.path.isdir(export_dir): os.mkdir(export_dir)
print export_dir
filename = os.path.join(export_dir, 'capture_' + str(idx) + '.png') 
print filename

zoom = 1

if capture:
    rCommonCap(filename, viewport_name, zoom)
# ---------- end capture_to_bitmap ----------

# ----
# Network visualization
number_slider = Slider(0, range=0..47)
show_8 = BooleanToggle(True)
network_viz = GhPythonScript(assembly=initial_assembly.assembly, show_network=show_8, key=number_slider)  # -> out, nodes, edges, current_node, current_node_neighbors; inputs key: Int32
# ---------- network_viz: Python ----------
import sys, os
import ghpythonlib.components as ghcomp
from compas.datastructures import Network
from compas_ghpython.artists import NetworkArtist
from compas_rhino.geometry import RhinoLine

import compas_ghpython
import Rhino.Geometry as rg


data = assembly.network.to_data()
network = Network.from_data(data)

print assembly.network.number_of_nodes()

def draw_network(network):
    """Draw a network in Grasshopper.
    """
    points = []
    for key, attr in network.nodes(True):
        points.append({
            'pos': network.node_coordinates(key),
        })

    lines = []
    for (u, v), attr in network.edges(True):
        lines.append({
            'start': network.node_coordinates(u),
            'end': network.node_coordinates(v),
        })

    points_rg = compas_ghpython.draw_points(points)
    lines_rg = compas_ghpython.draw_lines(lines)

    return points_rg, lines_rg

if show_network:
    nodes, edges = draw_network(network)
    
    current_node = {'pos': network.node_coordinates(key), 'radius': 0.03}
    current_node = compas_ghpython.draw_spheres([current_node])
    
    current_node_neighbors_keys = network.neighbors(key)
    current_node_neighbors = [{'pos': network.node_coordinates(key), 'radius': 0.02} for key in current_node_neighbors_keys]
    current_node_neighbors = compas_ghpython.draw_spheres(current_node_neighbors)
# ---------- end network_viz ----------
pt = Point(network_viz.nodes)
line = Line(network_viz.edges)
brep = Brep(network_viz.current_node)
brep_2 = Brep(network_viz.current_node_neighbors)
preview = CustomPreview(Geometry=brep_2, Material=ColourSwatch(SwatchColor=RGB(255, 207, 207)))
preview_2 = CustomPreview(Geometry=[brep, line], Material=ColourSwatch(SwatchColor=RGB(0, 0, 0)))

# ----
# Export .json
export = Button()
export_2 = Button()
export_3 = PythonScript(DATA=py.DATA, assembly=initial_assembly.assembly, export_to_json=export, export_to_json_unity=export_2)
# ---------- export_3: Python ----------
import os
from compas.datastructures.mesh import mesh_quads_to_triangles
from compas.datastructures.mesh import mesh_unify_cycles

if export_to_json:
    filename = "assembly_example_02.json"
    PATH = os.path.join(DATA, "assembly", filename)
    
    # the assembly has to be serialized such that it can be called from CPython, True to enable pretty print
    assembly.to_json(PATH, True)
    

if export_to_json_unity:
    
    for key, e in assembly.elements():
    
        #convert to trimesh
        mesh_quads_to_triangles(e._mesh, check_angles=False)
        #mesh_unify_cycles(e._mesh)
        #print e._mesh.faces
        #print e._mesh.face_vertices(list(e._mesh.faces())[0])

    filename = "unity_assembly_test.json"
    PATH = os.path.join(DATA, "assembly", filename)
    assembly.to_json(PATH)
# ---------- end export_3 ----------
