# Grasshopper definition Chovghi - Equilibrium local.ghx (Grasshopper 1.0.7)
# Copyright: Felswind

point = Point([Point(0, 0, 0), Point(0, -1.001743697, 9.164840485), Point(1.287317407, 5.322568512, 9.164840485)])
point_2 = Point([Point(0, 0, 0), Point(2.450189542, 0, 0), Point(1.815926151, 2.029241683, 0)])
local_eq = LocalEquilibrium(cp=point, sp=point_2)  # -> la, rp; inputs cp: list of Point3d, sp: list of Point3d
# ---------- local_eq: Python ----------
"""Calculates the local static Equilibrium condition.
    Inputs:
        cp: Mid Points of the elements
    Output:
        la: lever arm [m]
        rp: Position of the Resultant Z-Vector [Point]"""

__author__ = "Frederic Chovghi"

ghenv.Component.Name = "Local Equilibrium"
ghenv.Component.NickName = "Local Eq."

import rhinoscriptsyntax as rs
import math



##########################################################################################
## Main Inputs
##########################################################################################

l = 0.5 #Length of the Rods [m]
r = 0.025 #Radius of the Pipe Elements



##########################################################################################
## Function
##########################################################################################

def Local_Equilibrium(cp, sp, l, r):
    if cp and sp:
        # Variables:
        # cp = Center Points of the individual elements of one branch
        # sp = Planar Supports of the branch
        # l = #Length of the Rods [m]
        # r = #Radius of the Pipe Elements
        
        
        #Step 1: Calculate single Resultants
        vol = l * math.pi * r**2 #Volume Vector for Rods; Material weight is considered as constant
        cp0 = [(p[0], p[1], 0) for p in cp] #Planar Center Points of the Resultant
        sp = [(p[0], p[1], 0) for p in sp] #Make Supports planar
        
        
        #Step 2: Calculate the Resultant for each branch
        res_pos_loc = []
        res_pos_x = 0
        res_pos_y = 0
        
        for i, cp0l in enumerate(cp0):
            m_x = cp0l[0] * vol
            m_y = cp0l[1] * vol
            
            res_pos_x += m_x #Local Moment in x-dir
            res_pos_y += m_y #Local Moment in y-dir
            
            res_pos_x_loc = res_pos_x / (vol*(i+1)) #Position of Resultant in x-dir
            res_pos_y_loc = res_pos_y / (vol*(i+1)) #Position of Resultant in y-dir
            
            rp = rs.AddPoint(res_pos_x_loc, res_pos_y_loc, 0)
            
            #Lever Arm for a single Branch
            if len(sp) == 1:
                la = rs.Distance(rp, sp)
            
            #Lever Arm for two Branches
            if len(sp) == 2:
                l = rs.AddLine(sp[0], sp[1])
                la = rs.Distance(rs.EvaluateCurve(l, rs.CurveClosestPoint(l, rp)), rp)
            
            #Lever Arm for multiple Branches
            if len(sp) > 2:
                sp.append(sp[0])
                l = rs.AddPolyline(sp)
                
                check = rs.PointInPlanarClosedCurve(rp, l)
                if check == 1 or check == 2: la = 0
                if check == 0: la = rs.Distance(rs.EvaluateCurve(l, rs.CurveClosestPoint(l, rp)), rp)
    
    else:
        la = 'No Input'
        rp = 'No Input'
    
    return([la, rp])



##########################################################################################
## Run Function
##########################################################################################

LE = Local_Equilibrium(cp, sp, l, r)
la = LE[0]
rp = LE[1]
# ---------- end local_eq ----------
panel = Panel(local_eq.la)
point_3 = Point(local_eq.rp)
